# Grasshopper definition code.gh (Grasshopper 1.0.8)
# plug-ins: RhinoCodePluginGH

objects = QueryModelObjects(Layer="Baffle Centerlines", Locked=True, Hidden=True, AutoUpdateState=True)  # -> flatten(Objects)
geometry_analysis = Python3Script(
    centerline_layer="Baffle Centerlines",
    active_objects=objects,
    offset=Slider(24, range=0.1..100),
    extend=Slider(54, range=10..1000),
    break_length=Slider(20, range=1..100),
    min_corner_radius=Slider(299, range=0.1..4000),
    max_corner_radius=Slider(1200, range=0.1..4000),
    min_corner_length=Slider(250, range=0.1..4000),
    max_corner_length=Slider(3500, range=0.1..4000))  # -> centerline_offset_curves, corner_arc_points, baffle_end_points, baffle_break_points, centerline_offset_curves_2, baffles_corner, baffles_straight, corner_radius_condition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; inputs active_objects: list
# ---------- geometry_analysis: Python ----------
import Rhino as rh
import Rhino.Geometry as rg
import scriptcontext as sc

import polars
import torch
import numpy




if min_corner_radius > max_corner_radius: min_corner_radius = max_corner_radius
if min_corner_length > max_corner_length: min_corner_length = max_corner_length


sc.doc = rh.RhinoDoc.ActiveDoc

curve_layer_name = centerline_layer

curve_layer_idx = sc.doc.Layers.Find(curve_layer_name, True)
curve_layer = sc.doc.Layers.FindIndex(curve_layer_idx)
layer_objects = sc.doc.Objects.FindByLayer(curve_layer)

line_point_list = []
stagger_point_list = []
layer_curves = []


# cut_circle_layer_idx = sc.doc.Layers.Find("cut_circles", True)
# cut_circle_layer = sc.doc.Layers.FindIndex(cut_circle_layer_idx)
# cut_circle_objects = sc.doc.Objects.FindByLayer(cut_circle_layer)
# cut_circles = [obj.Geometry for obj in cut_circle_objects]

#Join Curves into PolyCurves if they are not one already
#joined_curves = rg.Curve.JoinCurves([el.Geometry for el in layer_objects])
joined_curves = [el.Geometry for el in layer_objects]


""" CENTERLINE CLASS """
class Centerline:

    def __init__(self, name = "", centerline= None):
        self.name = name
        self.centerline = centerline

    def get_offset(self):
        right = self.centerline.Offset(rg.Plane.WorldXY, -offset, 0.001, rg.CurveOffsetCornerStyle.NONE)[0]
        left = self.centerline.Offset(rg.Plane.WorldXY, offset, 0.001, rg.CurveOffsetCornerStyle.NONE)[0]
        return [right, left]

    def get_arcs(self):
        return [crv for crv in self.centerline.GetSubCurves() if type(crv) == rg.ArcCurve]

    def get_lines(self):
        return [crv for crv in self.centerline.GetSubCurves() if type(crv) == rg.LineCurve]

    def get_inset_lines(self):
        curve_list = []
        sub_curves = self.centerline.GetSubCurves()
        for crv in sub_curves:
            if type(crv) == rg.LineCurve:
                ptA = crv.PointAtLength(extend)
                ptB = crv.PointAtLength(crv.GetLength()-extend)
                curve_list.append(rg.Line(ptA, ptB))
        return curve_list

    def get_arc_curves(self):
        sub_curves = self.centerline.GetSubCurves()
        lines = [crv for crv in sub_curves if type(crv) == rg.LineCurve]
        arcs = [crv for crv in sub_curves if type(crv) == rg.ArcCurve]
        corners = []
        for i, crv in enumerate(sub_curves):
            if type(crv) == rg.ArcCurve:
                if i == 0:
                    ptA = crv.PointAtEnd
                    ptB = lines[0].PointAtStart
                    a_line = rg.Line(ptA, ptB)
                elif i > 0 and i < len(sub_curves)-1:
                    ptA = crv.PointAtStart
                    ptB = crv.PointAtEnd
                    ptC = sub_curves[i-1].PointAtLength(sub_curves[i-1].GetLength() - extend)
                    ptD = sub_curves[i+1].PointAtLength(extend)
                    crvA = rg.Line(ptC, ptA).ToNurbsCurve()
                    crvB = rg.Line(ptB, ptD).ToNurbsCurve()
                    a_corner = rg.Curve.JoinCurves([crvA, crv, crvB])[0]
                    corners.append(a_corner)
                else:
                    ptA = crv.PointAtStart
                    ptB = crv.PointAtEnd
                    ptC = sub_curves[i-1].PointAtLength(sub_curves[i-1].GetLength() - extend)
                    crvA = rg.Line(ptC, ptA).ToNurbsCurve()
                    a_corner = rg.Curve.JoinCurves([crvA, crv])[0]
                    corners.append(a_corner)
        return corners
                

 
centerline_listing = []
for i, curve in enumerate(joined_curves):
    base_curve = Centerline(f"baseline curve{i}", curve)
    centerline_listing.append(base_curve)


inset_line_listing = []
for centerline in centerline_listing:
    for line in centerline.get_inset_lines():
        inset_line_listing.append(line)
    centerline.get_arc_curves()


short_baffles = []
break_point_listing = []
break_point_cutters = []
for centerline in centerline_listing:
    for line in centerline.get_inset_lines():
        if line.Length > 3500:
            break_points = line.ToNurbsCurve().DivideEquidistant(line.Length/2)
            break_point_listing.append(break_points[1])

            break_point_cutters.append(rg.Circle(rg.Plane.WorldXY, break_points[1], break_length))
        elif line.Length < 1200:
            short_baffles.append(line)


arc_curve_listing = []
for centerline in centerline_listing:
    for line in centerline.get_arc_curves():
        arc_curve_listing.append(line)


corner_radius_condition = []
offset_curves = []
for centerline in centerline_listing:
    #
    for el in centerline.get_offset():
        offset_curves.append(el)
    #
    sub_curves = centerline.centerline.GetSubCurves()
    sub_curves = centerline.centerline.GetSubCurves()
    #
    for curve in sub_curves:
        #
        if type(curve) == rg.LineCurve:
            # print("LINE")
            ptA = curve.PointAtLength(extend)
            ptB = curve.PointAtLength(curve.GetLength()-extend)

            line_point_list.append(curve.PointAtStart)
            line_point_list.append(curve.PointAtEnd)

            stagger_point_list.append(ptA)
            stagger_point_list.append(ptB)

        elif type(curve) == rg.ArcCurve:

            if min_corner_radius < curve.Radius < max_corner_radius:
                pass
                # print("GOOD ARC")
            else:
                # print("BAD ARC")
                corner_radius_condition.append(curve)


corner_length_condition = []
for centerline in centerline_listing:
    #
    sub_curves = centerline.get_arc_curves()
    #
    for curve in sub_curves:
        print(round(curve.GetLength()))
        if min_corner_length < curve.GetLength() < max_corner_length:
            pass
            print("GOOD ARC")
        else:
            print("BAD ARC")
            corner_length_condition.append(curve)



""" Break Point Study """
#cut_width_offset = 10
# cut_surfaces = []
# for circle in cut_circles:
#     new_circle = circle.Duplicate()
#     xform = rg.Transform.Scale(new_circle.Arc.Center, cut_width_offset)
#     new_circle.Transform(xform)
#     srf = rg.Brep.CreatePlanarBreps([new_circle], .001)[0]
#     # print(srf)
#     cut_surfaces.append(srf)
# cutters = [el.Faces[0] for el in cut_surfaces]

# cut_points = []
# for circle in cut_circles:
#     for centerline in centerline_listing:
#         #curve_cut = rg.Curve.CreateBooleanDifference(centerline.centerline, cut_circles,.001)
#         sect = rg.Intersect.Intersection.CurveCurve(circle,centerline.centerline, .001, .001)
#         # if len(curve_cut) > 0:
#         #     print(curve_cut[0])
#         if sect.Count > 0:
#             for x in sect:
#                 cut_points.append(x.PointA)



centerline_offset_curves = offset_curves
corner_arc_points = line_point_list
baffle_end_points = stagger_point_list
baffles_corner = arc_curve_listing
baffles_straight = inset_line_listing
baffle_break_points = break_point_listing
baffle_break_cutters = break_point_cutters
baffle_length_condition = short_baffles
# ---------- end geometry_analysis ----------

pt = Point(geometry_analysis.corner_arc_points)
pt_2 = Point(geometry_analysis.baffle_break_points)
pt_3 = Point(geometry_analysis.baffle_end_points)
crv = Curve(geometry_analysis.centerline_offset_curves)

crv_2 = Curve(geometry_analysis.centerline_offset_curves_2)
crv_3 = Curve(geometry_analysis.baffles_straight)
crv_4 = Curve(geometry_analysis.corner_radius_condition)
crv_5 = Curve(geometry_analysis.corner_length_condition)
crv_6 = Curve(geometry_analysis.baffle_break_cutters)
crv_7 = Curve(geometry_analysis.baffles_corner)
crv_8 = Curve(geometry_analysis.baffle_length_condition)
