# Grasshopper definition flow_form_01.gh (Grasshopper 1.0.8)

# ----
# Project
# Initiation
# Component
project_loader = Python3Script()
# ---------- project_loader: Python ----------
#r: numpy, scipy
# ---------- end project_loader ----------

overlays = ValueList({"Areas", "Clusters"}, selected=[])
S = Script(overlay_layer="Overlays")  # inputs overlay_layer: String
# ---------- S: Python ----------
import Grasshopper as gh
import Rhino as rh 
import scriptcontext as sc 


sc.doc = rh.RhinoDoc.ActiveDoc


component_name = "Overlays"

layer = overlay_layer
overlay_root = "{}".format(overlay_layer)


overlay_root_layer_idx = sc.doc.Layers.Find(overlay_root, True)
overlay_root_layer = sc.doc.Layers.FindIndex(overlay_root_layer_idx)

overlays = [child.Name for child in overlay_root_layer.GetChildren()]


for obj in ghenv.Component.OnPingDocument().Objects:
    #
    if type(obj) is gh.Kernel.Special.GH_ValueList and obj.NickName == component_name:
        if obj.ListItems.Count > 0:
            selected = obj.SelectedItems if obj.ListItems.Count > 0 else None
        obj.ListItems.Clear()
        for k, v in zip(overlays, overlays):
            vli = gh.Kernel.Special.GH_ValueListItem(k.strip(), "{}".format(v))
            obj.ListItems.Add(vli)

        if selected is not None:
            try:
                for i, item in enumerate(selected):
                    obj.ToggleItem(overlays.index(item.Name))
            except:
                pass
        obj.ExpireSolution(True)
# ---------- end S ----------

panel = Panel("FOR_CODE_TESTING")
panel_2 = Panel("centerlines")
objects = QueryModelObjects(Layer="Baffle Centerlines", Locked=True, Hidden=True, AutoUpdateState=True)
# project values ->
objects_2 = QueryModelObjects(Layer="Baffle Centerlines", Locked=True, Hidden=True, AutoUpdateState=True)  # -> flatten(Objects)
area_info = Script(
    project_library_path="E:/Projects/rjcd/rhino/Baffle Project Machine/code/",
    area_layer="Overlays::Areas",
    reset=Button(ExpressionNormal="True"))  # -> data_output, area_names; inputs area_layer: String
# ---------- area_info: Python ----------
import Rhino as rh
import Grasshopper as gh
import ghpythonlib.components as ghcomp
import scriptcontext as sc
import rhinoscriptsyntax as rs

import sys
import importlib as imp


sys.path.append(project_library_path)

# import acoufelt.Design.Investigate as Investigate
# import acoufelt.Design.ImageWall as ImageWall
# import acoufelt.Project.Shop as Shop

# imp.reload(Investigate)
# imp.reload(ImageWall)
# imp.reload(Shop)


import pjctpy as pjct

print(pjct)


sc.doc = rh.RhinoDoc.ActiveDoc

# Get Area area_layer Layer String
a_layer = sc.doc.Layers.FindByFullPath(area_layer, True)
area_layer = sc.doc.Objects.FindByLayer(sc.doc.Layers.FindIndex(a_layer))
print(len(area_layer), type(area_layer))
# Key Layer (Closed Curves)
key_areas = []
for area in area_layer:
    if type(area) == rh.DocObjects.CurveObject:
        if area.Geometry.IsClosed:
            key_areas.append(area.Geometry)


project_areas = []
for i, area in enumerate(key_areas):
    leaders = [
        leader for leader in area_layer if type(leader) is rh.DocObjects.LeaderObject
    ]
    name = "Area {}".format(i + 1)
    for leader in leaders:
        intersect = rh.Geometry.Intersect.Intersection.CurveCurve(
            area, leader.Geometry.Curve, 1, 1
        )
        if intersect:
            name = leader.Geometry.PlainText
            break
    # new_area = Shop.ProjectArea(name=name, area_curve=area)
    # project_areas.append(new_area)

# class DataOutput: pass

# data_output = DataOutput()
# data_output.project_areas = project_areas

# area_names = sorted([p.name for p in project_areas])
# ---------- end area_info ----------
py3 = Python3Script(
    centerline_objects=objects,
    centerline_layer="Baffle Centerlines",
    max_baffle_length=Slider(1790, range=100..10000),
    baffle_depth=Slider(500, range=100..600),
    thickness=Slider(48, range=12..100),
    area_layer="Overlays::Areas")  # -> data_out; inputs centerline_objects: list of Curve, area_layer: String
# ---------- py3: Python ----------
#r: numpy, scipy

import sys
import importlib as imp

import Rhino as rh
import Rhino.Geometry as rg
import scriptcontext as sc
import rhinoscriptsyntax as rs
import ghpythonlib as gh

import numpy as np

import projectpy as pjct


# sys.path.append(project_library_path)
# imp.reload(pjct)


# set the environment
sc.doc = rh.RhinoDoc.ActiveDoc

# Get Area area_layer Layer String
a_layer = sc.doc.Layers.FindByFullPath(area_layer, True)
area_layer = sc.doc.Objects.FindByLayer(sc.doc.Layers.FindIndex(a_layer))
print(len(area_layer), type(area_layer))
# Key Layer (Closed Curves)
key_areas = []
for area in area_layer:
    if type(area) == rh.DocObjects.CurveObject:
        if area.Geometry.IsClosed:
            key_areas.append(area.Geometry)


# Empty lists to store data
baffle_centerlines_polars, baffle_centerlines_id_polars = [], []
baffles_polars, baffles_name_polars, baffles_length_polars = [], [], []
baffles_type_polars, baffles_type_obj_polars = [], []
baffle_hanging_points, baffle_surfaces, baffle_solids, baffle_planes = [], [], [], []


curve_layer_name = centerline_layer
curve_layer_idx = sc.doc.Layers.Find(curve_layer_name, True)
curve_layer = sc.doc.Layers.FindIndex(curve_layer_idx)
layer_objects = sc.doc.Objects.FindByLayer(curve_layer)

centerline_object_list = []

# Iterating over layer objects
for i, obj in enumerate(layer_objects):
    # Get depth attribute, fallback to default if missing or invalid
    obj_depth = obj.Attributes.GetUserString("depth")
    obj_depth = float(obj_depth) if obj_depth and obj_depth.replace(".", "", 1).isdigit() else baffle_depth

    # Create BaffleCenterline object
    baffle_centerline = pjct.Project.BaffleCenterline(
        name=f"Centerline {pjct.Utils.alpha[i].upper()}",
        centerline=obj,
        max_baffle_length=max_baffle_length
    )

    # Collect hanging points
    baffle_hanging_points.extend(baffle_centerline.hanging_points)
    # Generate connection planes
    for curve in baffle_centerline.connection_lines():
        offset = curve.Offset(rg.Plane.WorldXY, 1, 0.01, rg.CurveOffsetCornerStyle.NONE)[0]
        baffle_planes.append(rg.Plane(curve.PointAtMid, offset.PointAtMid - curve.PointAtMid, curve.PointAtEnd - curve.PointAtMid))

    # Generate surfaces and solids
    for baffle in baffle_centerline.baffles:
        baffle_surfaces.append(baffle.surface(depth=-obj_depth))
        baffle_solids.append(baffle.solid(thickness=thickness, depth=-obj_depth))

    # Store baffle centerline object
    centerline_object_list.append(baffle_centerline)

    # Store baffle properties
    for baffle in baffle_centerline.baffles:
        baffles_polars.append(baffle)
        baffle_centerlines_polars.append(baffle_centerline)
        baffle_centerlines_id_polars.append(str(baffle_centerline.centerline.Id))
        baffles_name_polars.append(baffle.name)
        baffles_length_polars.append(round(baffle.baffle_curve.ToNurbsCurve().GetLength(), 2))
        baffles_type_polars.append(type(baffle.baffle_curve).__name__)
        baffles_type_obj_polars.append(baffle.baffle_curve)



group_name = "plate_withGrippers"

# Delete existing group if it exists, then create a new one
gripper_group = sc.doc.Groups.FindName(group_name)
if gripper_group:
    pjct.Utils.delete_group_items(group_name)
    sc.doc.Groups.Delete(gripper_group)

gripper_group = sc.doc.Groups.Add(group_name)

world = rg.Plane.WorldXY
normal_vec = rg.Vector3d(0, 0, 1)
block = sc.doc.InstanceDefinitions.Find(group_name)

for plane in baffle_planes:
    if plane.ZAxis * normal_vec < 0:
        plane.Flip()
    plane.Rotate(np.radians(90), normal_vec)
    
    xform = rg.Transform.PlaneToPlane(world, plane)
    instance_id = sc.doc.Objects.AddInstanceObject(block.Index, xform)
    sc.doc.Groups.AddToGroup(gripper_group, instance_id)



group_name = "baffles"
baffle_group = sc.doc.Groups.FindName(group_name)

if baffle_group:
    pjct.Utils.delete_group_items(group_name)
    sc.doc.Groups.Delete(baffle_group)
baffle_group = sc.doc.Groups.Add(group_name)

for baffle in baffle_solids:
    instance_id = sc.doc.Objects.Add(baffle)
    instance_object = sc.doc.Objects.Find(instance_id)
    sc.doc.Groups.AddToGroup(baffle_group, instance_object.Id)



a = baffle_hanging_points
b = baffle_surfaces
c = baffle_solids

baffle_dataframe_dictionary = dict(
    centerlines = baffle_centerlines_polars,
    centerline_id = baffle_centerlines_id_polars,
    baffles = baffles_polars,
    baffle_name = baffles_name_polars,
    baffle_length = baffles_length_polars,
    baffle_type = baffles_type_polars,
    baffle_type_obj = baffles_type_obj_polars
)

data_out = pjct.Utils.DataOutput()
data_out.baffles = baffle_dataframe_dictionary
data_out.max_length = max_baffle_length
# ---------- end py3 ----------
project_areas = ValueList()
crv = Curve([<curve referenced from the Rhino model> x2])

# ----
# corner baffle ->
number_slider = Slider(1200, range=0.1..4000)

# ----
# straight baffle ->
# Working component
number_slider_2 = Slider(2800, range=0.1..4000)

script = Script(I=area_info.area_names)  # inputs I: list
# ---------- script: Python ----------
__organization__ = "Acoufelt"
__author__ = "JC"
__version__ = "2022.12.29"

import Rhino as rh
import ghpythonlib as gp
import scriptcontext as sc
import rhinoscriptsyntax as rs

import math
import random
import operator
import os

import Grasshopper as gh


Keys = list(I)
Name = "Project Areas"

##
for obj in ghenv.Component.OnPingDocument().Objects:
    #
    if type(obj) is gh.Kernel.Special.GH_ValueList:
        #
        if obj.NickName == Name:
            #
            if obj.ListItems.Count > 0:
                selected = obj.SelectedItems
            else:
                selected = None
            #
            obj.ListItems.Clear()
            #
            for k,v in zip(Keys, Keys):
                vli = gh.Kernel.Special.GH_ValueListItem(k.strip(), '"{}"'.format(v))
                obj.ListItems.Add(vli)
            
            if selected is not None:
                for i, item in enumerate(selected):
                    obj.ToggleItem(Keys.index(item.Name))  

            obj.ExpireSolution(True)
# ---------- end script ----------
py3_2 = Python3Script(
    input_polyline=crv,
    max_arc_length=Slider(2600, range=100..4000),
    min_arc_length=Slider(600, range=20..5000),
    min_angle=Slider(30, range=1..180))  # -> a, b; inputs input_polyline: Curve
# ---------- py3_2: Python ----------
import Rhino.Geometry as rg
import numpy as np



is_closed = input_polyline.ToNurbsCurve().IsClosed
poly_segments = [l.ToNurbsCurve() for l in input_polyline.ToPolyline().GetSegments()]

import Rhino.Geometry as rg
import math

def create_fillet(segment, next_segment, max_arc_length, min_arc_length, min_angle_degrees):
    vecA = rg.Vector3d(segment.PointAtEnd - segment.PointAtStart)
    vecB = rg.Vector3d(next_segment.PointAtEnd - next_segment.PointAtStart)
    angle = rg.Vector3d.VectorAngle(vecA, vecB)
    
    min_angle_radians = math.radians(min_angle_degrees)
    
    # If the angle is less than the minimum, don't create a fillet
    if angle < min_angle_radians:
        return None
    
    # Calculate the minimum radius based on the minimum angle
    min_radius_from_angle = min_arc_length / min_angle_radians
    
    # Calculate radius based on actual angle and arc length constraints
    max_radius = max_arc_length / angle
    min_radius = max(min_arc_length / angle, min_radius_from_angle)
    
    # Choose a radius within the allowed range
    radius = max(min(max_radius, max_arc_length / min_angle_radians), min_radius)
    
    tan_dis = radius * math.tan(angle / 2)
    
    return rg.Curve.CreateFillet(segment, next_segment, radius, tan_dis, tan_dis)

# The rest of the code remains the same as in the previous example


def fillet_polyline(input_polyline, max_arc_length, min_arc_length, min_angle):
    is_closed = input_polyline.ToNurbsCurve().IsClosed
    poly_segments = [l.ToNurbsCurve() for l in input_polyline.ToPolyline().GetSegments()]

    fillet_arcs = []
    for i, segment in enumerate(poly_segments):
        if is_closed:
            next_segment = poly_segments[0] if i == len(poly_segments) - 1 else poly_segments[i + 1]
        elif i < len(poly_segments) - 1:
            next_segment = poly_segments[i + 1]
        else:
            break

        fillet = create_fillet(segment, next_segment, max_arc_length, min_arc_length, min_angle)
        
        if fillet:
            fillet_arcs.append(fillet)

    return fillet_arcs

fillet_arcs = fillet_polyline(input_polyline, max_arc_length, min_arc_length, min_angle)

fillet_lines = []
for i, arc in enumerate(fillet_arcs):

    if i == 0:
        a_line = rg.Line(poly_segments[0].PointAtStart, arc.StartPoint).ToNurbsCurve()
        fillet_lines.append(a_line)

    elif 0 < i < len(fillet_arcs)-1:
        a_line = rg.Line(arc.StartPoint, fillet_arcs[i-1].EndPoint).ToNurbsCurve()
        fillet_lines.append(a_line)
    else:
        a_line = rg.Line(fillet_arcs[i-1].EndPoint, arc.StartPoint ).ToNurbsCurve()
        b_line = rg.Line(arc.EndPoint, poly_segments[-1].PointAtEnd, ).ToNurbsCurve()
        fillet_lines.append(a_line)
        fillet_lines.append(b_line)    
a = fillet_arcs
b = fillet_lines

    # start1 = line1.PointAtStart
    # end1 = line1.PointAtEnd
    # start2 = line2.PointAtStart
    # end2 = line2.PointAtEnd

    # # Find the intersection point
    # intersection = rg.Intersect.Intersection.LineLine(line1, line2)[1]

    # # Calculate the angle between the lines
    # vec1 = end1 - start1
    # vec2 = end2 - start2
    # angle = rg.Vector3d.VectorAngle(vec1, vec2)

    # # Calculate the maximum radius based on the max arc length
    # max_radius = max_arc_length / angle

    # # Calculate the distance from intersection to tangent points
    # tangent_distance = max_radius * math.tan(angle / 2)

    # # Find the tangent points
    # dir1 = (end1 - start1).Unitize()
    # dir2 = (end2 - start2).Unitize()
    # tangent1 = intersection - dir1 * tangent_distance
    # tangent2 = intersection - dir2 * tangent_distance

    # # Create the fillet arc
    # plane = rg.Plane(tangent1, rg.Vector3d.CrossProduct(dir1, dir2))
    # fillet_arc = rg.Arc(plane, tangent1, intersection, tangent2)

    # return fillet_arc, max_radius, tangent1, tangent2
# ---------- end py3_2 ----------
py3_3 = Python3Script(data_in=py3)  # -> out, a, b, c, d, e
# ---------- py3_3: Python ----------
import polars as pl


baffle_dataframe_dictionary = data_in.baffles
max_baffle_length = data_in.max_length

pl.Config(tbl_cols=-1, fmt_str_lengths=3000, tbl_rows=-1, fmt_table_cell_list_len=2000, tbl_formatting="ASCII_MARKDOWN")

#
df = pl.DataFrame(baffle_dataframe_dictionary)

#
df2 = df.select(pl.col("baffle_type").value_counts().alias("counts"))

#
df3 = df.group_by("centerlines").agg(
    baffle_length =pl.col("baffle_length"),
    total_length=pl.col("baffle_length").sum(),
    total_type_count = pl.col("baffle_type").value_counts(),
    object_count = pl.col("baffle_name")
)
print(df2)
print(df3)
#
df4 = df.filter(pl.col("baffle_length") > max_baffle_length)
print(df4)
#
curve_list = [item["baffles"].baffle_curve for item in df4.iter_rows(named=True)]
print(curve_list)



a = df
b = df2
c = df3
d = df4
e = curve_list
# ---------- end py3_3 ----------
py3_4 = Python3Script(data_in=py3, path="E:/Projects/rjcd/rhino/flow_form/code/")  # -> out, a
# ---------- py3_4: Python ----------
import json
import polars as pl
import projectpy as pjct



# Convert the baffle data from the input into a dictionary
baffle_dataframe_dictionary = data_in.baffles

# Create a Polars DataFrame from the baffle dictionary
df = pl.DataFrame(baffle_dataframe_dictionary)

# Select specific columns from the DataFrame and convert to a list of dictionaries
baffle_data = df.select([
    pl.col("baffle_name"),    # select the 'baffle_name' column
    pl.col("baffle_length"),  # select the 'baffle_length' column
    pl.col("centerline_id"),  # select the 'centerline_id' column
    pl.col("baffle_type")     # select the 'baffle_type' column
]).to_dicts()

# Print the resulting baffle data
print(baffle_data)

# Save the baffle data to a JSON file
# The file will be named 'data.json' and saved in the directory specified by 'path'
pjct.Utils.save_to_json(baffle_data, f"{path}data.json")
# ---------- end py3_4 ----------
crv_2 = Curve(py3_2.b)
crv_3 = Curve(py3_2.a)
block_data = Script(
    create_xlsx=Toggle(False),
    xlsx_filename="200527_ShopDrawing_V6",
    block_pattern="^([A-Z][0-9]{1,2})",
    data_input=area_info.data_output,
    active_areas=project_areas)  # -> area_bounding_boxes; inputs active_areas: list
# ---------- block_data: Python ----------
import Rhino as rh 
import scriptcontext as sc 
import rhinoscriptsyntax as rs 

import random
import re

#r: polars, xlsxwriter
import polars as pl 
import xlsxwriter


sc.doc = rh.RhinoDoc.ActiveDoc
project_areas = data_input.project_areas


"""
Functions
"""
# Set Projects Areas as Active Projects
active_project_areas = []
for project in project_areas:
    if active_areas:
        if project.name in active_areas:
            active_project_areas.append(project)

blocks = sc.doc.InstanceDefinitions
project_blocks = []
for block in blocks:
    match = re.match(str(block_pattern), block.Name)
    if match:
        project_blocks.append(block)


# # Listing of Cloud Block Definitions
def definition_listing(p_blocks):
    count = 1
    blocks,counts,lengths,widths,geometry,connections,areas = [],[],[],[],[],[],[]

    for block in p_blocks:
        counts.append(block.UseCount())
        count += 1
        connection_types = []
        #
        for el in block.GetObjects():
            #
            if el.ObjectType == rh.DocObjects.ObjectType.InstanceReference:
                if el.InstanceDefinition.Name in connection_types or '"' in el.InstanceDefinition.Name:
                    pass
                else:
                    connection_types.append(el.InstanceDefinition.Name)
            #
            if el.ObjectType == rh.DocObjects.ObjectType.Curve:
                form = el.Geometry.HasNurbsForm()
                if form == 2:
                    geo = "Curved" 
                    break
                else:
                    geo = "Rectangle"
        #
        geometry.append(geo)
        connection = list(set(connection_types))
        instance = rs.BlockInstances(block.Name)[0]
        box =  rh.Geometry.BoundingBox(rs.BoundingBox(instance))
        area_label = block.Name[0]

        blocks.append(block.Name)
        lengths.append(round(box.ToBrep().Edges[0].GetLength(),1))
        widths.append(round(box.ToBrep().Edges[1].GetLength(),1))
        connections.append(connection)
        areas.append(f"Area {area_label}")

    return {"block": blocks,"instances":counts,"length": lengths,"width": widths,"geometry":geometry , "area": areas, "connection":connections}




# Area Bounding Boxes for output
area_bounding_boxes = []
for project in active_project_areas:
    area_bounding_boxes.append(project.bounding_box(30))

listing = definition_listing(project_blocks)
# listing = reference_listing()

df = pl.DataFrame(listing)
#
selected = df.select(
    pl.col("block"),
    pl.col("instances").cast(pl.Int8), 
    pl.col("length").cast(pl.Int32), 
    pl.col("width").cast(pl.Int32),
    pl.col("geometry"),
    pl.col("area"),
    pl.col("connection").map_elements(', '.join, return_dtype=pl.String))

df_sorted = selected.select(pl.col("*").sort_by(["area"]))

print(df_sorted)

if create_xlsx == True:
    with xlsxwriter.Workbook(f"{xlsx_path}{xlsx_filename}.xlsx") as wb:
        df_sorted.write_excel(workbook = wb, worksheet="Sheet 1")
        mrows, mcols = df_sorted.shape
        ws = wb.get_worksheet_by_name("Sheet 1")  # set the current sheet
        ws.set_paper(25) # D sheet param
        ws.set_page_view(1) # Page Layout param
        ws.set_column('F:F', 20)
        ws.set_column('G:G', 50)
        header = "&L&G"
        ws.set_margins(top=1.3)
        ws.set_header(header, {"image_left":"E://Acoufelt//Resource//files//logo_black_small.png"})

        # wb.close()
# ---------- end block_data ----------
number_slider_3 = Slider(1, range=1..1000)
crv_4 = Curve([crv_3, crv_2])
py3_5 = Python3Script(x=Slider(10, range=1..1000))  # -> a; inputs x: Int32
# ---------- py3_5: Python ----------
import numpy as np


a = list(np.linspace(1,10,x,True))
# ---------- end py3_5 ----------
brep = Brep(block_data)
baffle_machine = Python3Script(
    centerline_layer="Baffle Centerlines",
    active_objects=objects_2,
    offset=Slider(24, range=0.1..100),
    extend=Slider(54, range=10..1000),
    break_length=Slider(20, range=1..100),
    min_corner_radius=Slider(300, range=0.1..4000),
    max_corner_radius=number_slider,
    min_corner_length=Slider(300, range=0.1..4000),
    max_corner_length=Slider(3500, range=0.1..4000),
    min_straight_length=Slider(300, range=0.1..4000),
    max_straight_length=number_slider_2)  # -> offset_line_listing, baffles_corner, baffles_straight, corner_radius_condition, corner_length_short, corner_length_long, baffle_length_condition, baffle_break_cutters, a_new_variable, data_out; inputs active_objects: list
# ---------- baffle_machine: Python ----------
#r: numpy, scipy

import Rhino as rh
import Rhino.Geometry as rg
import scriptcontext as sc

import impact.Project as ip
import impact.Utils as iu

# check floor
if min_corner_radius >= max_corner_radius:
    min_corner_radius = max_corner_radius
if min_corner_length >= max_corner_length:
    min_corner_length = max_corner_length
#
alpha = "abcdefghijklmnopqrstuvwxyz"

# set the environment
sc.doc = rh.RhinoDoc.ActiveDoc

# Rhino Centerline Objects
# TODO: better var names man
curve_layer_name = centerline_layer
curve_layer_idx = sc.doc.Layers.Find(curve_layer_name, True)
curve_layer = sc.doc.Layers.FindIndex(curve_layer_idx)
layer_objects = sc.doc.Objects.FindByLayer(curve_layer)

# TODO: Break / Cutter dev
# cut_circle_layer_idx = sc.doc.Layers.Find("cut_circles", True)
# cut_circle_layer = sc.doc.Layers.FindIndex(cut_circle_layer_idx)
# cut_circle_objects = sc.doc.Objects.FindByLayer(cut_circle_layer)
# cut_circles = [obj.Geometry for obj in cut_circle_objects]

# Join the layer curves if they have not been already
# These joined curves are no longer associated with the 
# Rhino Object space
joined_curves = [el.Geometry for el in layer_objects]

# empty lists to store some stuff later
line_point_list = []
stagger_point_list = []
layer_curves = []



""" Making Objects by DocObjects"""
# Iterating
centerline_object_list = []
for i, obj in enumerate(layer_objects):
    print(obj.Id)
    baffle_centerline = ip.BaffleCenterline(name=f"Centerline {i}", centerline=obj)
    centerline_object_list.append(baffle_centerline)

##
baffle_object_list = []
for i, obj in enumerate(centerline_object_list):
    # create a Baffle Object
    baffle = ip.Baffle(name = f"{alpha[i]}", 
                    baffle_curve = obj.centerline.Geometry, 
                    baffle_centerline = obj)
    #
    baffle_object_list.append(baffle)



##
centerline_baffle_listing = []
for i, centerline in enumerate(centerline_object_list):
    #
    for j, line in enumerate(centerline.get_inset_lines()):
        num = f"{j+1}".upper()
        a_baffle = ip.Baffle(name=f'{alpha[i]} - {num}', baffle_curve = line, baffle_centerline=centerline)
        centerline_baffle_listing.append(a_baffle)



""" Making Objects by Curves"""
# Make a Listing of Centerline Objects
centerline_listing = []
for i, curve in enumerate(joined_curves):
    base_curve = ip.BaffleCenterline(f"CENTERLINE - {i}", curve)
    centerline_listing.append(base_curve)


# # Get all straight lines inset for straight baffle ckurves
inset_line_listing = []
for centerline in centerline_listing:
    inset_line_listing.append(centerline.centerline)


# baffle_listing = []
# for i, centerline in enumerate(centerline_listing):
#     for j, line in enumerate(centerline.get_inset_lines()):
#         a_baffle = Baffle(name=f'{alpha[i]} - {j+1}', baffle_line = line, centerline=centerline)
#         baffle_listing.append(a_baffle)


# baffle_centerline_listing = []
# for i, centerline in enumerate(centerline_listing):
#     a_baffle = Baffle(name=f'{alpha[i]} - {j+1}', baffle_line = line, centerline=centerline)
#     baffle_centerline_listing.append(a_baffle)



""" Making Outputs """
#
offset_line_listing = []
for centerline in centerline_object_list:
        for line in centerline.get_inset_lines(extend=extend, break_length=break_length):
            try:
                crv = line.ToNurbsCurve()
                right = crv.Offset(rg.Plane.WorldXY, offset, 0.001, rg.CurveOffsetCornerStyle.NONE)[0]
                left = crv.Offset(rg.Plane.WorldXY, -offset, 0.001, rg.CurveOffsetCornerStyle.NONE)[0]
                offset_line_listing.append(right)
                offset_line_listing.append(left)
                start_crv = rg.Line(right.PointAtStart, left.PointAtStart).ToNurbsCurve()
                end_crv = rg.Line(right.PointAtEnd, left.PointAtEnd).ToNurbsCurve()
                offset_line_listing.append(start_crv)
                offset_line_listing.append(end_crv)
                crvA, crvB = rg.Line(right.PointAtStart, left.PointAtStart), rg.Line(right.PointAtEnd, left.PointAtEnd)
                crv_joined = rg.Curve.JoinCurves([right, crvA, left, crvB])[0]
                print(crv_joined)
                offset_line_listing.append(crv_joined)
            except:
                pass

# #
offset_corner_listing = []
for centerline in centerline_object_list:
        for line in centerline.get_corners(extend = extend):
            try:
                crv = line.ToNurbsCurve()
                right = crv.Offset(rg.Plane.WorldXY, offset, 0.001, rg.CurveOffsetCornerStyle.NONE)[0]
                left = crv.Offset(rg.Plane.WorldXY, -offset, 0.001, rg.CurveOffsetCornerStyle.NONE)[0]
                offset_line_listing.append(right)
                offset_line_listing.append(left)
                start_crv = rg.Line(right.PointAtStart, left.PointAtStart).ToNurbsCurve()
                end_crv = rg.Line(right.PointAtEnd, left.PointAtEnd).ToNurbsCurve()
                offset_line_listing.append(start_crv)
                offset_line_listing.append(end_crv)
                crvA, crvB = rg.Line(right.PointAtStart, left.PointAtStart), rg.Line(right.PointAtEnd, left.PointAtEnd)
                crv_joined = rg.Curve.JoinCurves([right, crvA, left, crvB])[0]
                print(crv_joined)
                offset_line_listing.append(crv_joined)
            except:
                pass


# #
short_baffles = []
for centerline in centerline_object_list:
    for line in centerline.get_inset_lines(extend=extend, break_length=break_length):
        if line.ToNurbsCurve().GetLength() < min_straight_length:
            short_baffles.append(line)
        else:
            pass


# #
break_point_listing = []
break_point_cutters = []
for centerline in centerline_object_list:
    for line in centerline.get_inset_lines(extend=extend, break_length=break_length):
        if line.ToNurbsCurve().GetLength() >= max_straight_length:
            break_points = line.ToNurbsCurve().DivideEquidistant(line.GetLength() / 2)
            break_point_listing.append(break_points[1])
            break_point_cutters.append(
                rg.Circle(rg.Plane.WorldXY, break_points[1], break_length)
            )


# #
corner_length_short = []
corner_length_long = []
corners_good = []
for centerline in centerline_object_list:
    #
    sub_curves = centerline.get_corners()
    #
    for curve in sub_curves:
        if curve.GetLength() < min_corner_length:
            corner_length_short.append(curve)
        elif curve.GetLength() >  max_corner_length:
            corner_length_long.append(curve)
        else:
            corners_good.append(curve)         


# #
corner_radius_condition = []
for centerline in centerline_object_list:
    #
    sub_curves = centerline.get_corners(extend = extend)
    #
    for curve in sub_curves:
        for crv in curve.GetSubCurves():
            if type(crv) == rg.ArcCurve:
                if min_corner_radius <= crv.Radius <= max_corner_radius:
                    pass
                else:
                    corner_radius_condition.append(curve)

# #
corner_listing = []
for centerline in centerline_object_list:
    #
    sub_curves = centerline.get_corners(extend = extend)
    #
    for curve in sub_curves:
        corner_listing.append(curve)


for i, obj in enumerate(centerline_object_list):
    print([obj.name])

""" Break Point Study """

a_new_variable = 10
corner_arc_points = line_point_list
baffle_end_points = stagger_point_list
baffles_corner = centerline_object_list
baffles_corner = corner_listing
baffles_straight = inset_line_listing
baffle_break_points = break_point_listing
baffle_break_cutters = break_point_cutters
baffle_length_condition = short_baffles



""" Data Output """

data_out = iu.DataOutput()
data_out.baffle_objects = centerline_baffle_listing
data_out.centerline_objects = centerline_object_list
data_out.baf_objects = baffle_object_list
# ---------- end baffle_machine ----------
graph = GraphMapper(py3_5, x0=0, x1=1, y0=0, y1=1, Ox=0.5409088135, Oy=0.4772727489, Px=0, Py=0.3863636255, container_name="Parabola")
panel_3 = Panel(py3_5)
py3_6 = Python3Script(input_num=graph, y=Slider(1, range=1..1000))  # -> a
# ---------- py3_6: Python ----------
a = input_num*(y+1)
# ---------- end py3_6 ----------
panel_4 = Panel(graph)

crv_5 = Curve(baffle_machine.baffle_break_cutters)
crv_6 = Curve(baffle_machine.corner_radius_condition)
crv_7 = Curve(baffle_machine.corner_length_short)
crv_8 = Curve(baffle_machine.corner_length_long)
crv_9 = Curve(baffle_machine.baffle_length_condition)

crv_10 = Curve(baffle_machine.baffles_corner)
crv_11 = Curve(baffle_machine.baffles_straight)
crv_12 = Curve(baffle_machine.offset_line_listing)

pt = Point(<point referenced from the Rhino model>)
crv_13 = Curve(py3_3.e)
crv_14 = Curve(<curve referenced from the Rhino model>)
pt_2 = Point(<point referenced from the Rhino model>)
panel_5 = Panel(py3_3.a)
panel_6 = Panel(py3_3.b)
panel_7 = Panel(py3_3.c)
panel_8 = Panel(py3_3.d)
py3_7 = Python3Script(
    baffles_list=crv_11,
    data_in=baffle_machine.data_out,
    origin=pt_2,
    baffle_guide_curve=crv_14,
    by_curve=Toggle(True),
    baffle_height=Slider(300, range=4..1000),
    baffle_length=Slider(2692, range=1..5000),
    max_baffle_length=Slider(2800, range=1..3000),
    blocking_distance=Slider(435, range=4..1000),
    blocking_loc_inset=Slider(40, range=1..100),
    material_thickness=Slider(12, range=1..24),
    blocking_length_top=Slider(53, range=1..1000),
    blocking_length_btm=Slider(71, range=1..1000),
    sheet_layout_origin=pt)  # -> b, c, d, e, f, g, h, i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; inputs baffles_list: list of Line, origin: Point3d, baffle_guide_curve: Curve, sheet_layout_origin: Point3d
# ---------- py3_7: Python ----------
import impact.Project as ip


import Rhino as rh
import Rhino.Geometry as rg
import scriptcontext as sc
import rhinoscriptsyntax as rs



import math
# import torch
# import numpy as np
# import polars as pl


baffle_width = 48
#
baffle_guide_curve_length = baffle_guide_curve.GetLength()
baffle_height = 100 if not baffle_height else baffle_height
baffle_length = baffle_length if baffle_length <= max_baffle_length else max_baffle_length
baffle_cut_curve_length = baffle_length if not by_curve else baffle_guide_curve_length




""" Make Production Objects """

# def make_cutlines(origin: rg.Point3d):

# ip.CutFile
class CutFile:

    def __init__(self,
                baffle,
                baffle_length: float, 
                baffle_height: float, 
                origin_point: rg.Point3d, 
                blocking_shoulder: float, 
                blocking_hip: float,
                blocking_inset: float,
                blocking_spacing: float ):

        self.baffle = baffle
        self.height = baffle_height
        self.length = baffle_length
        self.origin_point = origin_point
        self.blocking_shoulder=blocking_shoulder
        self.blocking_hip = blocking_hip
        self.blocking_inset = blocking_inset
        self.blocking_spacing = blocking_spacing


    def centerline(self):
        #
        centerline_start = rg.Point3d(self.origin_point)
        #
        centerline_start.Y = centerline_start.Y + self.length
        #
        centerline = rg.Line(self.origin_point, centerline_start).ToNurbsCurve()
        #
        return centerline

    #
    def sidecut(self):
        #
        centerline = self.centerline()
        print(centerline)
        #
        top_crv = centerline.Offset(rg.Plane.WorldXY, -self.height, 0.001, rg.CurveOffsetCornerStyle.NONE)[0]
        #
        sideL = rg.Line(centerline.PointAtStart, top_crv.PointAtStart).ToNurbsCurve()
        #
        sideR = rg.Line(centerline.PointAtEnd, top_crv.PointAtEnd).ToNurbsCurve()
        #
        joined = rg.Curve.JoinCurves([sideL, top_crv, sideR])[0]
        #
        a_plane = rg.Plane(rg.Point3d(centerline.PointAtMid), rg.Vector3d(0,1,0), rg.Vector3d(0,0, 1))
        xform_plane = rg.Transform.Mirror(a_plane)
        #
        flipped = joined.Duplicate()
        flipped.Transform(xform_plane)
        #
        rejoined = rg.Curve.JoinCurves([joined, flipped])[0]
        #
        return rejoined


    def centerline_inset(self):
        #
        centerline = self.centerline()
        #
        centerline_inset = rg.Line(centerline.PointAtLength(self.blocking_inset), centerline.PointAtLength((centerline.GetLength() - self.blocking_inset)),).ToNurbsCurve()
        #
        return centerline_inset


    def blocking_centerlines(self):
        #
        blocking_count = int(self.centerline_inset().GetLength()/self.blocking_spacing)
        #
        blocking_points = [self.centerline_inset().PointAt(loc) for loc in self.centerline_inset().DivideByCount(blocking_count, True)]
        #
        blocking_centerlines = []
        #
        for pt in blocking_points:
            new_pt = rg.Point3d(pt)
            new_pt.X = new_pt.X-baffle_height
            blocking_centerlines.append(rg.Line(pt, new_pt).ToNurbsCurve())
        #
        return blocking_centerlines


    def blocking_curves(self):
        #
        blocking_centerlines = self.blocking_centerlines()
        #
        blocking_curves = []
        #
        for line in blocking_centerlines:
            #
            c_pt = line.ToNurbsCurve().PointAtMid
            #
            ptA, ptB = rg.Point3d(c_pt), rg.Point3d(c_pt)
            #
            ptA.X, ptA.Y = ptA.X - ((line.GetLength()/2)-self.blocking_shoulder), ptA.Y- (material_thickness/2)
            # ptA.Y = ptA.Y- (material_thickness/2)
            ptB.X, ptB.Y = ptB.X + ((line.GetLength()/2)-self.blocking_hip), ptB.Y + (material_thickness/2)
            # ptB.Y = ptB.Y + (material_thickness/2)
            a_plane = line.FrameAt(line.GetLength()/2)
            #
            a_rect = rg.Rectangle3d(a_plane[1], ptA, ptB)
            #
            blocking_curves.append(a_rect)
        #
        mirror_plane = rg.Plane(rg.Point3d(self.centerline().PointAtMid), rg.Vector3d(0,1,0), rg.Vector3d(0,0, 1))
        xform_plane = rg.Transform.Mirror(mirror_plane)
        #
        blocking_mirrored = []
        for curve in blocking_curves:
            a_crv = curve.ToNurbsCurve().Duplicate()
            a_crv.Transform(xform_plane)
            blocking_mirrored.append(a_crv)

        return blocking_curves + blocking_mirrored








## WALL OBJECTS
##
baffle_end_point = rg.Point3d(origin)
baffle_end_point.Y = baffle_end_point.Y + baffle_cut_curve_length
#
baffle_line = rg.Line(origin, baffle_end_point).ToNurbsCurve()
baffle_line_inset = rg.Line(baffle_line.Duplicate().PointAtLength(blocking_loc_inset),baffle_line.Duplicate().PointAtLength((baffle_line.GetLength() - blocking_loc_inset)),).ToNurbsCurve()
#

blocking_count = int(baffle_line_inset.GetLength()/blocking_distance)
print([el for el in baffle_line_inset.DivideByCount(blocking_count, True)])
blocking_points = [baffle_line_inset.PointAt(loc) for loc in baffle_line_inset.DivideByCount(blocking_count, True)]
#
baffle_top_line = baffle_line.ToNurbsCurve().Offset(rg.Plane.WorldXY, -baffle_height, 0.001, rg.CurveOffsetCornerStyle.NONE)[0]
endsL = rg.Line(baffle_line.PointAtStart, baffle_top_line.PointAtStart).ToNurbsCurve()
endsR = rg.Line(baffle_line.PointAtEnd, baffle_top_line.PointAtEnd).ToNurbsCurve()
#
baffle_boundry = rg.Curve.JoinCurves([endsL, baffle_top_line, endsR])[0]
#
blocking_shoulder = blocking_length_top
blocking_hip = blocking_length_btm


## Make the centerlines for the blocking stiffner curves
blocking_centerlines = []
for pt in blocking_points:
    new_pt = rg.Point3d(pt)
    new_pt.X = new_pt.X-baffle_height
    blocking_centerlines.append(rg.Line(pt, new_pt).ToNurbsCurve())

## Create the bocking stiffner curves
blocking_curves = []
for line in blocking_centerlines:
    c_pt = line.ToNurbsCurve().PointAtMid
    ptA, ptB = rg.Point3d(c_pt), rg.Point3d(c_pt)
    ptA.X = ptA.X - ((line.GetLength()/2)-blocking_shoulder)
    ptA.Y = ptA.Y- (material_thickness/2)
    ptB.X = ptB.X + ((line.GetLength()/2)-blocking_hip)
    ptB.Y = ptB.Y + (material_thickness/2)
    a_plane = line.FrameAt(line.GetLength()/2)
    a_rect = rg.Rectangle3d(a_plane[1], ptA, ptB)
    blocking_curves.append(a_rect)

## Mirror the wall cut geometry
a_plane = rg.Plane(rg.Point3d(baffle_line.PointAtMid), rg.Vector3d(0,1,0), rg.Vector3d(0,0, 1))
xform_plane = rg.Transform.Mirror(a_plane)
#
baffle_boundry_mirrored = baffle_boundry.Duplicate()
baffle_boundry_mirrored.Transform(xform_plane)
#
blocking_mirrored = []
for curve in blocking_curves:
    a_crv = curve.ToNurbsCurve().Duplicate()
    a_crv.Transform(xform_plane)
    blocking_mirrored.append(a_crv)


#
baffle_btm_offset = 50
baffle_btm_origin = rg.Point3d(origin)
baffle_btm_origin.X = baffle_btm_origin.X + (baffle_height) + baffle_btm_offset
#
baffle_btm_corner = rg.Point3d(baffle_btm_origin)
baffle_btm_corner.X = baffle_btm_corner.X + baffle_width
baffle_btm_corner.Y = baffle_btm_corner.Y + baffle_cut_curve_length
#
baffle_btm_rect = rg.Rectangle3d(rg.Plane.WorldXY, baffle_btm_origin, baffle_btm_corner)

# baffle_line = rg.Line(origin, baffle_end_point).ToNurbsCurve()
# baffle_line_inset = rg.Line(baffle_line.Duplicate().PointAtLength(blocking_loc_inset),baffle_line.Duplicate().PointAtLength((baffle_line.GetLength() - blocking_loc_inset)),).ToNurbsCurve()
#
#
segments = baffle_btm_rect.ToPolyline().GetSegments()
btm_centerline = rg.Line(segments[0].ToNurbsCurve().PointAtMid, segments[2].ToNurbsCurve().PointAtMid).ToNurbsCurve()
#
btm_inset_line = btm_centerline.Duplicate()
ptA = btm_inset_line.PointAtLength(blocking_loc_inset)
ptB = btm_inset_line.PointAtLength((baffle_line.GetLength() - blocking_loc_inset))
btm_inset = rg.Line(ptA, ptB).ToNurbsCurve()
btm_blocking_points = [btm_inset.PointAt(loc) for loc in btm_inset.DivideByCount(blocking_count, True)]

## Make the centerlines for the blocking stiffner curves
btm_blocking_centerlines = []
for pt in btm_blocking_points:
    ptA, ptB = rg.Point3d(pt), rg.Point3d(pt)
    ptA.X, ptB.X = ptA.X - (material_thickness/2), ptB.X + (material_thickness/2)
    btm_blocking_centerlines.append(rg.Line(ptA,ptB).ToNurbsCurve())

## Create the bocking stiffner curves
btm_blocking_curves = []
for line in btm_blocking_centerlines:
    c_pt = line.ToNurbsCurve().PointAtMid
    ptA, ptB = rg.Point3d(c_pt), rg.Point3d(c_pt)
    ptA.X = ptA.X - (material_thickness/2)
    ptA.Y = ptA.Y- (material_thickness/2)
    ptB.X = ptB.X + (material_thickness/2)
    ptB.Y = ptB.Y + (material_thickness/2)
    a_plane = line.FrameAt(line.GetLength()/2)
    a_rect = rg.Rectangle3d(a_plane[1], ptA, ptB)
    btm_blocking_curves.append(a_rect)




""" Make 3d Objects """
#
offsetL = baffle_guide_curve.Duplicate().Offset(rg.Plane.WorldXY, -baffle_width / 2, 0.001, rg.CurveOffsetCornerStyle.NONE)[0]
offsetR = baffle_guide_curve.Duplicate().Offset(rg.Plane.WorldXY, baffle_width / 2, 0.001, rg.CurveOffsetCornerStyle.NONE)[0]
end_crvL = rg.Line(offsetL.PointAtStart, offsetR.PointAtStart).ToNurbsCurve()
end_crvR = rg.Line(offsetL.PointAtEnd, offsetR.PointAtEnd).ToNurbsCurve()
#
baffle_base_curve = rg.Curve.JoinCurves([offsetL, end_crvL, offsetR, end_crvR])[0]
baffle_top_curve = baffle_base_curve.Offset(rg.Plane.WorldXY, -10, 0.001, rg.CurveOffsetCornerStyle.Sharp)[0]
xform = rg.Transform.Translation(0, 0, material_thickness)
baffle_top_curve.Transform(xform)
top_parts = baffle_top_curve.GetSubCurves()
baffle_top_centerline = rg.Line(top_parts[0].PointAtMid,top_parts[2].PointAtMid).ToNurbsCurve()

##
blocking_count = int(baffle_top_centerline.GetLength()/blocking_distance)
new_points = [baffle_top_centerline.PointAt(loc) for loc in baffle_top_centerline.DivideByCount(blocking_count, True)]
planes = [baffle_top_centerline.PerpendicularFrameAt(loc) for loc in baffle_top_centerline.DivideByCount(blocking_count, True)]
#
unset = rg.Point3d.Unset

new_lofted_solid = rg.Brep.CreateFromLoft([baffle_base_curve, baffle_top_curve], unset, unset, rg.LoftType.Tight, False )

top_srf = None
btm_srf = None



""" """


#
#

baffle_objects = data_in.baffle_objects
sheet_spacing = 4000
baffle_listing_loc = []
cutfile_listing = []
centerline_objects = data_in.centerline_objects
  
for i, centerline_obj in enumerate(centerline_objects):
    print("")
    print(centerline_obj.centerline.Id)
    print(centerline_obj.get_lines())
    print(centerline_obj.get_arcs())
    print(centerline_obj.get_inset_lines())
    print(centerline_obj.get_corners())
# 
    len(centerline_objects)
    ptA = rg.Point3d(sheet_layout_origin)
    ptA.Y = ptA.Y + (sheet_spacing*i)
    for j, curve in enumerate(centerline_obj.get_lines()):
        print(curve.Length)
        if curve.Length > max_baffle_length:
            print("curve is too long")
        elif curve.Length < 300:
            print("too short")
        print("")

        ptB = rg.Point3d(ptA)
        ptB.X = ptB.X+(sheet_spacing*j)
        baffle_listing_loc.append(ptB)
        try:
            cutfile = ip.CutFile(curve, 
                            baffle_length = curve.Length, 
                            baffle_height = baffle_height,
                            origin_point = ptB,
                            blocking_shoulder = blocking_length_top, 
                            blocking_hip = blocking_length_btm,
                            blocking_inset = blocking_loc_inset, 
                            blocking_spacing = blocking_distance)

            cutfile_listing.append(cutfile)
        except: pass
    baffle_listing_loc.append(ptA)




# ptA = rg.Point3d(sheet_layout_origin)
# ptA.Y = ptA.Y + (sheet_spacing*i)
# for j, curve in enumerate(baffles_list):
#     print(round(curve.Length))
#     if curve.Length > max_baffle_length:
#         print("curve is too long")
#     elif curve.Length < 300:
#         print("too short")
#     print("")
#     ptB = rg.Point3d(ptA)
#     ptB.X = ptB.X+(sheet_spacing*j)
#     baffle_listing_loc.append(ptB)
#     try:
#         cutfile = CutFile(curve, 
#                         baffle_length = curve.Length, 
#                         baffle_height = baffle_height,
#                         origin_point = ptB,
#                         blocking_shoulder = blocking_length_top, 
#                         blocking_hip = blocking_length_btm,
#                         blocking_inset = blocking_loc_inset, 
#                         blocking_spacing = blocking_distance)

#         cutfile_listing.append(cutfile)
#     except: pass
# baffle_listing_loc.append(ptA)



""" Output """

a = a_plane[1]
# c = new_points
b = baffle_listing_loc
d = baffle_line
e = baffle_top_line
f = btm_blocking_curves
g = new_lofted_solid
# h = base_curve
i = [plane[1] for plane in planes]
j = blocking_curves
k = baffle_btm_rect
l = blocking_mirrored
m  = baffle_boundry
n = baffle_boundry_mirrored


with_sidecut = []
with_blocking = []
for cut in cutfile_listing:
    try:
        with_sidecut.append(cut.sidecut())
        with_blocking.append(cut.blocking_curves())
    except:
        print("error")

# aa = [crv for block in with_blocking for crv in block]
# ab = [cut for cut in with_sidecut]
# ---------- end py3_7 ----------
brep_2 = Brep(py3_7.g)
pt_3 = Point(py3_7.b)
pt_4 = Point(py3_7.c)
crv_15 = Curve(py3_7.f)
pln = Plane(py3_7.i)
crv_16 = Curve(py3_7.k)
pt_5 = Point(<point referenced from the Rhino model>)
crv_17 = Curve(<curve referenced from the Rhino model>)
py3_8 = Python3Script(blocking_distance=Slider(352, range=4..1000), arc_baffle=crv_17, offset_distance=Slider(48, range=1..1000), origin=pt_5)  # -> a, b, c, d, e, f, g, h, i; inputs arc_baffle: Curve, origin: Point3d
# ---------- py3_8: Python ----------
import Rhino as rh
import Rhino.Geometry as rg 
import scriptcontext as sc


#
offsets = []

crvL = arc_baffle.Offset(rg.Plane.WorldXY, -offset_distance/2, .01, rg.CurveOffsetCornerStyle.NONE)[0]
crvR = arc_baffle.Offset(rg.Plane.WorldXY, offset_distance/2, .01, rg.CurveOffsetCornerStyle.NONE)[0]
end_cap = rg.Line(crvL.PointAtEnd, crvR.PointAtEnd).ToNurbsCurve()
start_cap = rg.Line(crvL.PointAtStart, crvR.PointAtStart).ToNurbsCurve()

footprint = rg.Curve.JoinCurves([crvL, end_cap, crvR, start_cap])[0]
inset_footprint = footprint.Offset(rg.Plane.WorldXY,offset_distance/4, .01, rg.CurveOffsetCornerStyle.NONE)[0] 
# solo arc and length
arc_crv = [crv for crv in arc_baffle.GetSubCurves() if type(crv) == rg.ArcCurve][0].ToNurbsCurve()


new_arc = arc_crv.Duplicate()
new_arc.Rebuild(2, 3, True)

blocking_count = int(new_arc.GetLength()/blocking_distance)-1
print(blocking_count)

distance = round(new_arc.GetLength()/blocking_count,1)-2.5
print(distance)

#pt_eq = new_arc.DivideEquidistant(distance)
arc_division_locations = new_arc.DivideByCount(blocking_count+1, True)
new_arc_points = [new_arc.PointAt(loc) for loc in arc_division_locations]

frame_list = []
perp_frame_list = []
for loc in arc_division_locations:
    frame_list.append(new_arc.FrameAt(loc))
    perp_frame_list.append(new_arc.PerpendicularFrameAt(loc))


# Curve for straights at the end - use for measing offsets from ends
crvA = rg.Line(new_arc.PointAtEnd, arc_baffle.PointAtEnd)
crvB = rg.Line(new_arc.PointAtStart, arc_baffle.PointAtStart)
pt_list = [crvA, crvB]

# Wall Cut File Geometry
ptA, ptB = rg.Point3d(origin), rg.Point3d(origin)
ptB.X = ptB.X+300
ptB.Y = ptB.Y+new_arc.GetLength()
cut_crv_rect = rg.Rectangle3d(rg.Plane.WorldXY,ptA, ptB)


a = footprint
b = inset_footprint
c = [el[1] for el in frame_list]
d = [el[1] for el in perp_frame_list]
e = new_arc
f = new_arc_points
g = new_arc.PointAtMid
h = cut_crv_rect
i = [pt for pt in pt_list]
# ---------- end py3_8 ----------
crv_18 = Curve(py3_8.b)
pln_2 = Plane(py3_8.c)
pln_3 = Plane(py3_8.d)
crv_19 = Curve(py3_8.e)
pt_6 = Point(py3_8.f)
crv_20 = Curve(py3_8.a)
pt_7 = Point(py3_8.g)
crv_21 = Curve(py3_8.h)
crv_22 = Curve(py3_8.i)
