# Grasshopper definition flow_form_05.gh (Grasshopper 1.0.8)

# ----
# Project
# Initiation
# Component
project_loader = Python3Script()
# ---------- project_loader: Python ----------
#r: numpy, scipy
# ---------- end project_loader ----------

overlays = ValueList({"Solids", "Area", "Cluster"}, selected=["Solids", "Area", "Cluster"])
S = Script(overlay_layer="Overlays")  # inputs overlay_layer: String
# ---------- S: Python ----------
import Grasshopper as gh
import Rhino as rh
import scriptcontext as sc

sc.doc = rh.RhinoDoc.ActiveDoc

component_name = "Overlays"
overlay_root_layer_idx = sc.doc.Layers.Find(overlay_layer, True)
overlay_root_layer = sc.doc.Layers.FindIndex(overlay_root_layer_idx)
overlays = [child.Name for child in overlay_root_layer.GetChildren()]

for obj in ghenv.Component.OnPingDocument().Objects:
    if isinstance(obj, gh.Kernel.Special.GH_ValueList) and obj.NickName == component_name:
        selected = obj.SelectedItems if obj.ListItems.Count > 0 else None
        obj.ListItems.Clear()
        obj.ListItems.AddRange(gh.Kernel.Special.GH_ValueListItem(k.strip(), '"{}"'.format(k)) for k in overlays)

        if selected:
            try:
                for item in selected:
                    obj.ToggleItem(overlays.index(item.Name))
            except ValueError:
                pass
        obj.ExpireSolution(True)
# ---------- end S ----------

panel = Panel("E:/Projects/tpf/rhino/flow_form/code")
panel_2 = Panel("E:/Projects/rjcd/rhino/flow_form/code")
area_info = Script(project_library_path=panel_2, area_layer="Overlays::Area", reset=Button(ExpressionNormal="True"))  # -> data_output, area_names; inputs area_layer: String
# ---------- area_info: Python ----------
import Rhino as rh
import Grasshopper as gh
import ghpythonlib.components as ghcomp
import scriptcontext as sc
import rhinoscriptsyntax as rs

import sys
import importlib as imp


sys.path.append(project_library_path)

import projectpy.Project as pjct
imp.reload(pjct)
print(pjct)


sc.doc = rh.RhinoDoc.ActiveDoc

# Get Area area_layer Layer String
a_layer = sc.doc.Layers.FindByFullPath(area_layer, True)
area_layer = sc.doc.Objects.FindByLayer(sc.doc.Layers.FindIndex(a_layer))
print(len(area_layer), type(area_layer))
# Key Layer (Closed Curves)
key_areas = []
for area in area_layer:
    if type(area) == rh.DocObjects.CurveObject:
        if area.Geometry.IsClosed:
            key_areas.append(area.Geometry)


project_areas = []
for i, area in enumerate(key_areas):
    leaders = [
        leader for leader in area_layer if type(leader) is rh.DocObjects.LeaderObject
    ]
    name = "Area {}".format(i + 1)
    for leader in leaders:
        intersect = rh.Geometry.Intersect.Intersection.CurveCurve(
            area, leader.Geometry.Curve, 1, 1
        )
        if intersect:
            name = leader.Geometry.PlainText
            break
    # new_area = Shop.ProjectArea(name=name, area_curve=area)
    # project_areas.append(new_area)

# class DataOutput: pass

# data_output = DataOutput()
# data_output.project_areas = project_areas

# area_names = sorted([p.name for p in project_areas])
# ---------- end area_info ----------
project_areas = ValueList()
py3 = Python3Script(overlay_layer="Overlays", active_overlays=overlays)  # -> overlays; inputs active_overlays: list
# ---------- py3: Python ----------
import Rhino as rh
import scriptcontext as sc

sc.doc = rh.RhinoDoc.ActiveDoc
# project_areas = data_input.project_areas



# overlay_root_layer_idx = sc.doc.Layers.Find(overlay_layer, True)
# overlay_root_layer = sc.doc.Layers.FindIndex(overlay_root_layer_idx)
# overlays = [child.Name for child in overlay_root_layer.GetChildren()]

# Ensure active_overlays is initialized properly
# Ensure active_overlays is initialized as a list
active_overlays = active_overlays if active_overlays is not None else []

# Convert each overlay to a string, filtering out None values
active_overlays = [str(overlay) for overlay in active_overlays if overlay is not None]

for overlay_name in active_overlays:
    overlay_layer_idx = sc.doc.Layers.FindByFullPath(f"Overlays::{overlay_name}", -1)
    if overlay_layer_idx != -1:
        overlay_layer = sc.doc.Layers.FindIndex(overlay_layer_idx)
        overlay_layer_objects = sc.doc.Objects.FindByLayer(overlay_layer)
        
        # Check if overlay_layer_objects is not None before iterating
        if overlay_layer_objects is not None:
            overlay_objects = [
                obj for obj in overlay_layer_objects
                if isinstance(obj, rh.DocObjects.CurveObject) and obj.Geometry.IsClosed
            ]

overlays = active_overlays
# ---------- end py3 ----------
py3_2 = Python3Script(run=Toggle(True), api_port="8001", ui_port="8501")  # -> out, a; inputs api_port: Int32
# ---------- py3_2: Python ----------
"""Manages both Streamlit and FastAPI servers
    Inputs:
        run: Toggle servers (bool)
        ui_port: Streamlit port (default=8501)
        api_port: FastAPI port (default=8000)
    Outputs:
        out: Status message"""

import psutil
import flow_form.utils as utils

# import importlib
# importlib.reload(utils)

# Initialize inputs
if not run: run = False
if not ui_port: ui_port = 8501
if not api_port: api_port = 8000

try:
    # Start/stop both servers
    if run:
        ui_success = utils.manage_streamlit_server("start", ui_port)
        api_success = utils.manage_fastapi_server("start", api_port)
        
        if ui_success and api_success:
            output = f"Both servers started (UI:{ui_port}, API:{api_port})"
        elif ui_success:
            output = f"Only UI server started (port {ui_port})"
        elif api_success:
            output = f"Only API server started (port {api_port})"
        else:
            output = "Failed to start servers"
    else:
        utils.manage_streamlit_server("stop")
        utils.manage_fastapi_server("stop")
        output = "Servers stopped"
        
except Exception as e:
    output = f"Error: {str(e)}"
    print(f"Detailed error: {str(e)}")




"""FastAPI Server Cleanup
Inputs:
    run: Run cleanup (bool)
Outputs:
    out: Status message"""



def cleanup_fastapi_servers():
    killed = 0
    for proc in psutil.process_iter(['pid', 'name', 'cmdline']):
        try:
            cmdline = str(proc.info.get('cmdline', ''))
            if 'uvicorn' in cmdline and 'api_app:app' in cmdline:
                parent = psutil.Process(proc.info['pid'])
                for child in parent.children(recursive=True):
                    child.kill()
                parent.kill()
                killed += 1
        except:
            continue
    return killed

if not run:
    count = cleanup_fastapi_servers()
    output = f"Killed {count} FastAPI server(s)"
else:
    output = "Set run to True to cleanup servers"



"""Baffle Data Monitor
Inputs:
    run: Toggle monitoring (bool)
Outputs:
    out: Status message"""

if run:
    # Process any pending edits
    if utils.process_baffle_edits():
        # Update data after processing edits
        baffles = utils.get_baffle_data()
        output = f"Updated {len(baffles)} baffles"
    else:
        output = "No pending edits"
else:
    output = "Monitoring paused"
# ---------- end py3_2 ----------
crv = Curve(flatten(<curve referenced from the Rhino model>))
script = Script(I=area_info.area_names)  # inputs I: list
# ---------- script: Python ----------
__organization__ = "Acoufelt"
__author__ = "JC"
__version__ = "2022.12.29"

import Rhino as rh
import ghpythonlib as gp
import scriptcontext as sc
import rhinoscriptsyntax as rs

import math
import random
import operator
import os

import Grasshopper as gh


Keys = list(I)
Name = "Project Areas"

##
for obj in ghenv.Component.OnPingDocument().Objects:
    #
    if type(obj) is gh.Kernel.Special.GH_ValueList:
        #
        if obj.NickName == Name:
            #
            if obj.ListItems.Count > 0:
                selected = obj.SelectedItems
            else:
                selected = None
            #
            obj.ListItems.Clear()
            #
            for k,v in zip(Keys, Keys):
                vli = gh.Kernel.Special.GH_ValueListItem(k.strip(), '"{}"'.format(v))
                obj.ListItems.Add(vli)
            
            if selected is not None:
                for i, item in enumerate(selected):
                    obj.ToggleItem(Keys.index(item.Name))  

            obj.ExpireSolution(True)
# ---------- end script ----------
m_objects = QueryModelObjects(Layer="BaffleCenterlines", Locked=True, Hidden=True, AutoUpdateState=True)
panel_3 = Panel(py3)
py3_3 = Python3Script(
    input_polyline=crv,
    max_arc_length=Slider(2600, range=100..4000),
    min_arc_length=Slider(640, range=20..5000),
    min_angle=Slider(47, range=1..180))  # -> a, b; inputs input_polyline: Curve
# ---------- py3_3: Python ----------
import Rhino.Geometry as rg
import numpy as np



is_closed = input_polyline.ToNurbsCurve().IsClosed
poly_segments = [l.ToNurbsCurve() for l in input_polyline.ToPolyline().GetSegments()]


def create_fillet(segment, next_segment, max_arc_length, min_arc_length, min_angle_degrees):
    vecA = rg.Vector3d(segment.PointAtEnd - segment.PointAtStart)
    vecB = rg.Vector3d(next_segment.PointAtEnd - next_segment.PointAtStart)
    angle = rg.Vector3d.VectorAngle(vecA, vecB)
    
    min_angle_radians = np.radians(min_angle_degrees)

    # If the angle is less than the minimum, don't create a fillet
    if angle < min_angle_radians:
        return None
    
    # Calculate the minimum radius based on the minimum angle
    min_radius_from_angle = min_arc_length / min_angle_radians
    
    # Calculate radius based on actual angle and arc length constraints
    max_radius = max_arc_length / angle
    min_radius = max(min_arc_length / angle, min_radius_from_angle)
    
    # Choose a radius within the allowed range
    radius = max(min(max_radius, max_arc_length / min_angle_radians), min_radius)
    
    tan_dis = radius * np.tan(angle / 2)
    
    return rg.Curve.CreateFillet(segment, next_segment, radius, tan_dis, tan_dis)

# The rest of the code remains the same as in the previous example
def fillet_polyline(input_polyline, max_arc_length, min_arc_length, min_angle):
    is_closed = input_polyline.ToNurbsCurve().IsClosed
    poly_segments = [l.ToNurbsCurve() for l in input_polyline.ToPolyline().GetSegments()]

    fillet_arcs = []
    for i, segment in enumerate(poly_segments):
        if is_closed:
            next_segment = poly_segments[0] if i == len(poly_segments) - 1 else poly_segments[i + 1]
        elif i < len(poly_segments) - 1:
            next_segment = poly_segments[i + 1]
        else:
            break

        fillet = create_fillet(segment, next_segment, max_arc_length, min_arc_length, min_angle)
        
        if fillet:
            fillet_arcs.append(fillet)

    return fillet_arcs

fillet_arcs = fillet_polyline(input_polyline, max_arc_length, min_arc_length, min_angle)

fillet_lines = []
for i, arc in enumerate(fillet_arcs):

    if i == 0:
        a_line = rg.Line(poly_segments[0].PointAtStart, arc.StartPoint).ToNurbsCurve()
        fillet_lines.append(a_line)

    elif 0 < i < len(fillet_arcs)-1:
        a_line = rg.Line(arc.StartPoint, fillet_arcs[i-1].EndPoint).ToNurbsCurve()
        fillet_lines.append(a_line)
    else:
        a_line = rg.Line(fillet_arcs[i-1].EndPoint, arc.StartPoint ).ToNurbsCurve()
        b_line = rg.Line(arc.EndPoint, poly_segments[-1].PointAtEnd, ).ToNurbsCurve()
        fillet_lines.append(a_line)
        fillet_lines.append(b_line)    


from itertools import zip_longest

def combine_alternating_lengths(list1, list2):
    result = []
    for pair in zip_longest(list1, list2):
        result.extend(item for item in pair if item is not None)
    return result


# print(fillet_arcs)
# print(fillet_lines)
join_list = combine_alternating_lengths([el.ToNurbsCurve() for el in fillet_arcs], fillet_lines)
joined = rg.Curve.JoinCurves(join_list)
a = joined
b = fillet_lines

    # start1 = line1.PointAtStart
    # end1 = line1.PointAtEnd
    # start2 = line2.PointAtStart
    # end2 = line2.PointAtEnd

    # # Find the intersection point
    # intersection = rg.Intersect.Intersection.LineLine(line1, line2)[1]

    # # Calculate the angle between the lines
    # vec1 = end1 - start1
    # vec2 = end2 - start2
    # angle = rg.Vector3d.VectorAngle(vec1, vec2)

    # # Calculate the maximum radius based on the max arc length
    # max_radius = max_arc_length / angle

    # # Calculate the distance from intersection to tangent points
    # tangent_distance = max_radius * math.tan(angle / 2)

    # # Find the tangent points
    # dir1 = (end1 - start1).Unitize()
    # dir2 = (end2 - start2).Unitize()
    # tangent1 = intersection - dir1 * tangent_distance
    # tangent2 = intersection - dir2 * tangent_distance

    # # Create the fillet arc
    # plane = rg.Plane(tangent1, rg.Vector3d.CrossProduct(dir1, dir2))
    # fillet_arc = rg.Arc(plane, tangent1, intersection, tangent2)

    # return fillet_arc, max_radius, tangent1, tangent2
# ---------- end py3_3 ----------
panel_4 = Panel(py3_2.out)
block_data = Script(
    create_xlsx=Toggle(False),
    xlsx_filename="200527_ShopDrawing_V6",
    block_pattern="^([A-Z][0-9]{1,2})",
    project_library_path=panel_2,
    data_input=area_info.data_output,
    active_areas=project_areas)  # -> area_bounding_boxes; inputs active_areas: list
# ---------- block_data: Python ----------
import Rhino as rh 
import scriptcontext as sc 
import rhinoscriptsyntax as rs 

import random
import re

#r: polars, xlsxwriter
import polars as pl 
import xlsxwriter


sc.doc = rh.RhinoDoc.ActiveDoc
project_areas = data_input.project_areas



import sys
import importlib as imp


sys.path.append(project_library_path)

import projectpy.Project as pjct
imp.reload(pjct)
print(pjct)



"""
Functions
"""
# Set Projects Areas as Active Projects
active_project_areas = [project for project in project_areas if active_areas and project.name in active_areas]



blocks = sc.doc.InstanceDefinitions
project_blocks = []
for block in blocks:
    match = re.match(str(block_pattern), block.Name)
    if match:
        project_blocks.append(block)


# # Listing of Cloud Block Definitions
def definition_listing(p_blocks):
    count = 1
    blocks,counts,lengths,widths,geometry,connections,areas = [],[],[],[],[],[],[]

    for block in p_blocks:
        counts.append(block.UseCount())
        count += 1
        connection_types = []
        #
        for el in block.GetObjects():
            #
            if el.ObjectType == rh.DocObjects.ObjectType.InstanceReference:
                if el.InstanceDefinition.Name in connection_types or '"' in el.InstanceDefinition.Name:
                    pass
                else:
                    connection_types.append(el.InstanceDefinition.Name)
            #
            if el.ObjectType == rh.DocObjects.ObjectType.Curve:
                form = el.Geometry.HasNurbsForm()
                if form == 2:
                    geo = "Curved" 
                    break
                else:
                    geo = "Rectangle"
        #
        geometry.append(geo)
        connection = list(set(connection_types))
        instance = rs.BlockInstances(block.Name)[0]
        box =  rh.Geometry.BoundingBox(rs.BoundingBox(instance))
        area_label = block.Name[0]

        blocks.append(block.Name)
        lengths.append(round(box.ToBrep().Edges[0].GetLength(),1))
        widths.append(round(box.ToBrep().Edges[1].GetLength(),1))
        connections.append(connection)
        areas.append(f"Area {area_label}")

    return {"block": blocks,"instances":counts,"length": lengths,"width": widths,"geometry":geometry , "area": areas, "connection":connections}




# Area Bounding Boxes for output
area_bounding_boxes = []
for project in active_project_areas:
    area_bounding_boxes.append(project.bounding_box(30))

listing = definition_listing(project_blocks)
# listing = reference_listing()

df = pl.DataFrame(listing)
#
selected = df.select(
    pl.col("block"),
    pl.col("instances").cast(pl.Int8), 
    pl.col("length").cast(pl.Int32), 
    pl.col("width").cast(pl.Int32),
    pl.col("geometry"),
    pl.col("area"),
    pl.col("connection").map_elements(', '.join, return_dtype=pl.String))

df_sorted = selected.select(pl.col("*").sort_by(["area"]))

print(df_sorted)

if create_xlsx == True:
    with xlsxwriter.Workbook(f"{xlsx_path}{xlsx_filename}.xlsx") as wb:
        df_sorted.write_excel(workbook = wb, worksheet="Sheet 1")
        mrows, mcols = df_sorted.shape
        ws = wb.get_worksheet_by_name("Sheet 1")  # set the current sheet
        ws.set_paper(25) # D sheet param
        ws.set_page_view(1) # Page Layout param
        ws.set_column('F:F', 20)
        ws.set_column('G:G', 50)
        header = "&L&G"
        ws.set_margins(top=1.3)
        ws.set_header(header, {"image_left":"E://Acoufelt//Resource//files//logo_black_small.png"})

        # wb.close()
# ---------- end block_data ----------
button = Button()
area_info_2 = Script(project_library_path=panel, port="8505")  # -> data_output; inputs port: Int32; disabled
# ---------- area_info_2: Python ----------
import Rhino as rh
import Grasshopper as gh
import ghpythonlib.components as ghcomp
import scriptcontext as sc
import rhinoscriptsyntax as rs

import subprocess
import os
import sys

sys.path.append(project_library_path)

import flow_form as pjct


sc.doc = rh.RhinoDoc.ActiveDoc


if sc.sticky["streamlit_process"]: print(sc.sticky["streamlit_process"])

def start_streamlit_server(streamlit_script_path, port=8501):
    """Start a Streamlit server as a separate process"""
    
    # Get the Python executable that Rhino is using
    python_exe = r"C:\Users\jason\.rhinocode\py39-rh8\python.exe"
    
    # Command to run streamlit
    # Using -m streamlit is more reliable than direct streamlit command
    command = [python_exe, "-m", "streamlit", "run", streamlit_script_path, 
               "--server.port", str(port)]
    
    # Get the directory of the streamlit script
    app_dir = os.path.dirname(streamlit_script_path)
    
    try:
        # Start the process in a new console window (Windows-specific)
        process = subprocess.Popen(
            command,
            cwd=app_dir,
            creationflags=subprocess.CREATE_NEW_CONSOLE
        )
        
        # Store the process in the sticky dictionary for later access
        sc.sticky["streamlit_process"] = "UP"
        
        print(f"Streamlit server started with PID: {process.pid}")
        print(f"Streamlit app running at: http://localhost:{port}")
        
        return process
        
    except Exception as e:
        print(f"Failed to start Streamlit server: {e}")
        print(f"Command attempted: {' '.join(command)}")
        return None

# Path to your streamlit script
streamlit_script = f"{project_library_path}/interface/streamlit_app.py"

# Start the server
# start_streamlit_server(streamlit_script, port=port)

# interface\streamlit_app.py
# ---------- end area_info_2 ----------
py3_4 = Python3Script(
    centerline_objects=m_objects,
    run=Toggle(True),
    centerline_layer="BaffleCenterlines",
    max_baffle_length=Slider(2800, range=100..10000),
    baffle_depth=Slider(200, range=100..600),
    thickness=Slider(200, range=12..5000),
    area_layer="Overlays::Area",
    project_library_path=panel)  # -> out, data_out, d; inputs area_layer: String
# ---------- py3_4: Python ----------
import Rhino as rh
import Rhino.Geometry as rg
import scriptcontext as sc
import rhinoscriptsyntax as rs
import ghpythonlib as gh

import importlib as imp
import sys
sys.path.append(project_library_path)  # project_library_path points to ".../flow_form/code"

import flow_form as pjct
from flow_form.processor import BaffleConfig, BaffleManager
import flow_form.utils as utils

# Force reload the module to pick up changes
imp.reload(utils)
imp.reload(pjct)

sc.doc = rh.RhinoDoc.ActiveDoc

print(f"Active Rhino Document: {sc.doc}")
if not sc.doc:
    raise RuntimeError("No active Rhino document found.")

"""Monitors and processes baffle edits from Streamlit and exports baffle data
    Inputs:
        run: Toggle to enable edit monitoring (bool)
    Outputs:
        out: Status message
        a: Hanging points (list)
        b: Surfaces (list)
        c: Solids (list)
        d: Frames (list)
"""

if run:
    try:
        # Verify inputs
        if not area_layer or not isinstance(area_layer, str):
            raise ValueError("Invalid or missing 'area_layer'. It must be a string.")
        if not centerline_layer or not isinstance(centerline_layer, str):
            raise ValueError("Invalid or missing 'centerline_layer'. It must be a string.")
        if not isinstance(baffle_depth, (int, float)):
            raise ValueError("Invalid 'baffle_depth'. It must be a number.")
        if not isinstance(max_baffle_length, (int, float)):
            raise ValueError("Invalid 'max_baffle_length'. It must be a number.")
        if not isinstance(thickness, (int, float)):
            raise ValueError("Invalid 'thickness'. It must be a number.")

        print(f"Inputs are valid: area_layer={area_layer}, centerline_layer={centerline_layer}, "
              f"baffle_depth={baffle_depth}, max_baffle_length={max_baffle_length}, thickness={thickness}")

        # Initialize configuration
        config = BaffleConfig(
            area_layer=area_layer,
            centerline_layer=centerline_layer,
            baffle_depth=baffle_depth,
            max_baffle_length=max_baffle_length,
            thickness=thickness,
            data_path = project_library_path
        )
        print(f"BaffleConfig initialized: {config}")

        # Process baffles
        manager = BaffleManager(config)
        print(f"BaffleManager initialized: {manager}")
        hanging_points, surfaces, solids, frames, needs_recompute = manager.process_all()

        # Export baffle data to JSON
        print(f"Fetching baffle data for centerline_layer: {centerline_layer}")
        baffle_df = utils.get_baffle_data(centerline_layer)
        print(f"Baffle DataFrame: {baffle_df}")
        if not baffle_df.is_empty():
            export_status = f"Exported {len(baffle_df)} baffles to JSON"
        else:
            export_status = "No baffle data found to export"

        # Process edits from Streamlit
        print("Processing edits from Streamlit...")
        if utils.process_baffle_edits():
            edit_status = "Processed edits from Streamlit"
        else:
            edit_status = "No edits to process"
        print(edit_status)

        # Combine status messages
        output = f"{export_status}. {edit_status}."

        # Set outputs
        print(f"Hanging Points: {hanging_points}")
        print(f"Surfaces: {surfaces}")
        print(f"Solids: {solids}")
        print(f"Frames: {frames}")
        a = hanging_points
        b = surfaces
        c = solids
        d = frames

        # Trigger recompute if needed
        if needs_recompute:
            gh.ScheduleExpireSolution(10)

    except Exception as e:
        output = f"Error: {str(e)}"
        print(f"Exception occurred: {e}")
        a, b, c, d = None, None, None, None
else:
    output = "Monitoring disabled"
    a, b, c, d = None, None, None, None





    
#r: numpy, scipy, psutil

# import Rhino as rh
# import Rhino.Geometry as rg
# import scriptcontext as sc
# import rhinoscriptsyntax as rs
# import ghpythonlib as gh

# import numpy as np

# #
# import sys
# sys.path.append(project_library_path)

# import flow_form as pjct
# # 
# import os





# # --- ADDED: Configuration for File Paths & Edit Handling ---
# import json
# import os
# import polars as pl # Ensure polars is imported at the top as well
# from System import Guid # Ensure Guid is imported

# # --- Correct Path Construction ---
# # Assumes project_library_path = "E:/.../code"
# EDITS_FILE_IN = os.path.join(project_library_path, "data", "baffle_edits_in.json")
# # --- End Path Construction ---

# def read_edits_file(filepath):
#     """Reads the JSON edits file from Streamlit."""
#     if os.path.exists(filepath):
#         try:
#             with open(filepath, 'r') as f:
#                 content = f.read()
#                 if not content.strip(): return []
#                 return json.loads(content)
#         except json.JSONDecodeError:
#              print(f"Warning: Edits file {filepath} contains invalid JSON. Skipping edits.")
#              return []
#         except Exception as e:
#             print(f"Error reading edits file {filepath}: {e}")
#             return []
#     return []

# needs_recompute = False
# edits_applied_count = 0
# edit_status_message = "" # Specific status for edits

# edits_to_apply = read_edits_file(EDITS_FILE_IN)
# if os.path.exists(EDITS_FILE_IN):
#     try:
#         with open(EDITS_FILE_IN, 'w') as f: f.write("[]") # Clear file after reading
#     except Exception as e: print(f"Warning: Could not clear edits file {EDITS_FILE_IN}: {e}")

# if edits_to_apply:
#     print("Processing {} edits from file...".format(len(edits_to_apply)))
#     # Set context ONLY for applying edits
#     original_sc_doc = sc.doc # Store original context
#     sc.doc = rh.RhinoDoc.ActiveDoc
#     try:
#         for edit in edits_to_apply:
#             try:
#                 centerline_guid_str = edit.get('centerline_guid') # Expect GUID from Streamlit
#                 updates = edit.get('update')
#                 if not centerline_guid_str or not updates: continue
#                 depth_value = updates.get('depth')
#                 if depth_value is None: continue

#                 centerline_guid = Guid(centerline_guid_str)
#                 rh_obj = sc.doc.Objects.FindId(centerline_guid)
#                 if rh_obj and rh_obj.IsValid:
#                     print("Applying depth {} to {}".format(depth_value, centerline_guid))
#                     rh_obj.Attributes.SetUserString('depth', str(depth_value))
#                     if rh_obj.CommitChanges():
#                         edits_applied_count += 1
#                         needs_recompute = True
#                     else: print(f"Warning: Failed commit changes for {centerline_guid}")
#                 else: print(f"Warning: Centerline object {centerline_guid} not found or invalid when applying edit.")
#             except Exception as e: print(f"Error applying single edit {edit}: {e}")
#     finally:
#         sc.doc = original_sc_doc # Restore original context

#     if edits_applied_count > 0: edit_status_message = f"Applied {edits_applied_count} edits."
#     elif edits_to_apply: edit_status_message = "Edits found but none applied."
# # --- End of Added Edit Processing Logic ---







# # set the environment
# sc.doc = rh.RhinoDoc.ActiveDoc

# # Get Area area_layer Layer String
# a_layer = sc.doc.Layers.FindByFullPath(area_layer, True)
# area_layer = sc.doc.Objects.FindByLayer(sc.doc.Layers.FindIndex(a_layer))
# print(len(area_layer), type(area_layer))
# # Key Layer (Closed Curves)
# key_areas = []
# for area in area_layer:
#     if type(area) == rh.DocObjects.CurveObject:
#         if area.Geometry.IsClosed:
#             key_areas.append(area.Geometry)


# # Empty lists to store data
# baffle_centerlines_polars, baffle_centerlines_id_polars = [], []
# baffles_polars, baffles_name_polars, baffles_length_polars = [], [], []
# baffles_type_polars, baffles_type_obj_polars = [], []
# baffle_hanging_points, baffle_surfaces, baffle_solids, baffle_planes, baffle_frames = [], [], [], [], []
# centerline_object_list = []

# curve_layer_name = centerline_layer
# curve_layer_idx = sc.doc.Layers.Find(curve_layer_name, True)
# curve_layer = sc.doc.Layers.FindIndex(curve_layer_idx)
# layer_objects = sc.doc.Objects.FindByLayer(curve_layer)


# # Iterating over layer objects
# for i, obj in enumerate(layer_objects):
#     # Get depth attribute, fallback to default if missing or invalid
#     obj_depth = obj.Attributes.GetUserString("depth")
#     obj_depth = float(obj_depth) if obj_depth and obj_depth.replace(".", "", 1).isdigit() else baffle_depth

#     # Create BaffleCenterline object
#     baffle_centerline = pjct.Project.BaffleCenterline(
#         name=f"Centerline {pjct.Utils.alpha[i].upper()}",
#         centerline=obj,
#         max_baffle_length=max_baffle_length,
#         depth=obj_depth,
#         thickness = thickness
#     )

#     # Collect hanging points
#     baffle_hanging_points.extend(baffle_centerline.hanging_points)
#     # Generate connection planes
#     for curve in baffle_centerline.get_connection_lines():
#         offset = curve.Offset(rg.Plane.WorldXY, 1, 0.01, rg.CurveOffsetCornerStyle.NONE)[0]
#         baffle_planes.append(rg.Plane(curve.PointAtMid, offset.PointAtMid - curve.PointAtMid, curve.PointAtEnd - curve.PointAtMid))

#     # Generate surfaces and solids
#     for baffle in baffle_centerline.baffles:
#         b_srf = baffle.surface(depth=-baffle_centerline.depth)
#         baffle_surfaces.append(b_srf)

#         offset = rg.Brep.CreateOffsetBrep(b_srf.ToBrep(), -thickness/2, False, True, 0.01)[0][0]
#         solid = rg.Brep.CreateOffsetBrep(offset, thickness, True, True, 0.01)[0][0]
#         baffle_solids.append(solid)
#         baffle_frames.append(baffle.strut_frames())

#         # Store baffle centerline object
#         centerline_object_list.append(baffle_centerline)

#     # Store baffle properties
#     for baffle in baffle_centerline.baffles:
#         baffles_polars.append(baffle)
#         baffle_centerlines_polars.append(baffle_centerline)
#         baffle_centerlines_id_polars.append(str(baffle_centerline.centerline.Id))
#         baffles_name_polars.append(baffle.name)
#         baffles_length_polars.append(round(baffle.baffle_curve.ToNurbsCurve().GetLength(), 2))
#         baffles_type_polars.append(type(baffle.baffle_curve).__name__)
#         baffles_type_obj_polars.append(baffle.baffle_curve)



# group_name = "plate_withGrippers"
# # print(centerline_object_list)
# # Delete existing group if it exists, then create a new one
# gripper_group = sc.doc.Groups.FindName(group_name)
# if gripper_group:
#     pjct.Utils.delete_group_items(group_name)
#     sc.doc.Groups.Delete(gripper_group)

# gripper_group = sc.doc.Groups.Add(group_name)

# world = rg.Plane.WorldXY
# normal_vec = rg.Vector3d(0, 0, 1)
# block = sc.doc.InstanceDefinitions.Find(group_name)

# for plane in baffle_planes:
#     if plane.ZAxis * normal_vec < 0:
#         plane.Flip()
#     plane.Rotate(np.radians(90), normal_vec)
    
#     xform = rg.Transform.PlaneToPlane(world, plane)
#     instance_id = sc.doc.Objects.AddInstanceObject(block.Index, xform)
#     sc.doc.Groups.AddToGroup(gripper_group, instance_id)



# group_name = "baffles"
# baffle_group = sc.doc.Groups.FindName(group_name)

# if baffle_group:
#     pjct.Utils.delete_group_items(group_name)
#     sc.doc.Groups.Delete(baffle_group)
# baffle_group = sc.doc.Groups.Add(group_name)

# for baffle in baffle_solids:
#     instance_id = sc.doc.Objects.Add(baffle)
#     instance_object = sc.doc.Objects.Find(instance_id)
#     sc.doc.Groups.AddToGroup(baffle_group, instance_object.Id)



# # a = baffle_hanging_points
# # b = baffle_surfaces
# # c = baffle_solids
# # d = [frame[1] for baffle in baffle_frames for frame in baffle]

# baffle_dataframe_dictionary = dict(
#     centerline_list = centerline_object_list,
#     centerlines = baffle_centerlines_polars,
#     centerline_id = baffle_centerlines_id_polars,
#     baffles = baffles_polars,
#     baffle_name = baffles_name_polars,
#     baffle_length = baffles_length_polars,
#     baffle_type = baffles_type_polars,
#     baffle_type_obj = baffles_type_obj_polars
# )

# data_out = pjct.Utils.DataOutput()
# data_out.baffles = baffle_dataframe_dictionary
# data_out.max_length = max_baffle_length








# # --- ADDED: Create Polars DataFrame & Write Output File ---
# # This part uses the lists populated by YOUR original code above

# # --- Correct Path Construction ---
# DATA_FILE_OUT = os.path.join(project_library_path, "data", "baffle_data_out.json")
# # --- End Path Construction ---

# dataframe_out_str = "No data generated."
# final_status_message = edit_status_message if edit_status_message else "Completed." # Combine status

# # --- Create list of dictionaries for DataFrame from YOUR lists ---
# baffle_data_list = []
# # Check if your necessary lists were populated before trying to access them
# if 'baffles_name_polars' in locals() and 'baffle_centerlines_id_polars' in locals() and \
#    'baffle_centerlines_polars' in locals() and 'baffles_length_polars' in locals() and \
#    'baffles_type_polars' in locals():

#     num_baffles = len(baffles_name_polars)
#     for i in range(num_baffles):
#         try:
#             centerline_obj = baffle_centerlines_polars[i] # Get the BaffleCenterline object
#             baffle_data_list.append({
#                 "baffle_id": baffles_name_polars[i],
#                 "centerline_guid": baffle_centerlines_id_polars[i], # Already string GUID
#                 "centerline_name": centerline_obj.name,
#                 "length": baffles_length_polars[i],
#                 "depth": centerline_obj.depth, # Get depth from BaffleCenterline object
#                 "type": baffles_type_polars[i],
#             })
#         except IndexError: print("Warning: Index mismatch creating DataFrame data at index {}.".format(i))
#         except Exception as e: print("Warning: Error extracting data for DataFrame at index {}: {}".format(i, e))

# if baffle_data_list:
#     try:
#         current_baffle_df = pl.DataFrame(baffle_data_list)
#         dataframe_out_str = str(current_baffle_df)
#         os.makedirs(os.path.dirname(DATA_FILE_OUT), exist_ok=True)
#         current_baffle_df.write_json(DATA_FILE_OUT, row_oriented=True)
#         final_status_message += " Data written to JSON."
#         print(f"DataFrame successfully written to {DATA_FILE_OUT}")
#     except Exception as e:
#         print(f"Error creating/writing DataFrame: {e}")
#         dataframe_out_str = f"Error: {e}"
#         final_status_message = "Error writing data JSON."
# else:
#      try:
#          os.makedirs(os.path.dirname(DATA_FILE_OUT), exist_ok=True)
#          with open(DATA_FILE_OUT, 'w') as f: json.dump([], f)
#          final_status_message += " No baffle data generated."
#      except Exception as e:
#          print(f"Error writing empty data file: {e}")
#          final_status_message = "Error writing empty data JSON."

# # --- Update component outputs ---
# # Assign your original outputs first
# # Make sure these variables (baffle_hanging_points etc.) are correctly assigned by your preceding code
# a = baffle_hanging_points
# b = baffle_surfaces
# c = baffle_solids
# #d = [frame[1] for baffle_frame_list in baffle_frames for frame in baffle_frame_list if frame and len(frame) > 1 and frame[1] and frame[1].IsValid] # Use your original d= assignment
# d = [frame[1][1] for frame in baffle_frames]
# # Assign status and dataframe string representation IF outputs exist
# if "dataframe_out" in globals() or "dataframe_out" in locals(): dataframe_out = dataframe_out_str
# if "status" in globals() or "status" in locals(): status = final_status_message

# # --- ADDED: Trigger Recompute if Edits Were Applied ---
# if needs_recompute:
#     print("Scheduling recompute due to applied edits...")
#     gh.ScheduleExpireSolution(10)
# # --- End of Added Code ---







































# import Rhino as rh
# import Rhino.Geometry as rg
# import scriptcontext as sc
# import rhinoscriptsyntax as rs
# import ghpythonlib as gh

# import importlib as imp
# import sys
# sys.path.append(project_library_path)  # project_library_path points to ".../flow_form/code"


# import flow_form as pjct
# from flow_form.processor import BaffleConfig, BaffleManager
# import flow_form.Utils as utils

# # Force reload the module to pick up changes
# imp.reload(utils)
# imp.reload(pjct)

# sc.doc = rh.RhinoDoc.ActiveDoc


# """Monitors and processes baffle edits from Streamlit
#     Inputs:
#         run: Toggle to enable edit monitoring (bool)
#     Outputs:
#         out: Status message
# """


# # Initialize configuration
# config = BaffleConfig(
#     area_layer=area_layer,
#     centerline_layer=centerline_layer,
#     baffle_depth=baffle_depth,
#     max_baffle_length=max_baffle_length,
#     thickness=thickness
# )

# # Process baffles
# manager = BaffleManager(config)
# hanging_points, surfaces, solids, frames, needs_recompute = manager.process_all()

# # Set outputs
# a = hanging_points
# b = surfaces
# c = solids
# d = frames

# # Trigger recompute if needed
# if needs_recompute:
#     gh.ScheduleExpireSolution(10)
# ---------- end py3_4 ----------
crv_2 = Curve(py3_3.a)
crv_3 = Curve(py3_3.b)
py3_5 = Python3Script(project_library_path=panel)  # -> out, a
# ---------- py3_5: Python ----------
import importlib as imp
import sys
# sys.path.append(project_library_path)  # project_library_path points to ".../flow_form/code"

print(project_library_path)
# import flow_form as pjct
# from flow_form.processor import BaffleConfig, BaffleManager
# import flow_form.Utils as utils

# # Force reload the module to pick up changes
# imp.reload(utils)
# imp.reload(pjct)
# ---------- end py3_5 ----------
crv_4 = Curve([crv_2, crv_3])
brep = Brep(block_data)
pln = Plane(py3_4.d)
server_controller = Python3Script(project_library_path="E:\Projects\tpf\rhino\flow_form\code", run=Toggle(False), ws_port="8765", streamlit_port="8502")  # -> out, a; inputs streamlit_port: Int32
# ---------- server_controller: Python ----------
"""Manages both WebSocket and Streamlit servers
Inputs:
    run: Toggle servers (bool)
    ws_port: WebSocket port (default=8765)
    streamlit_port: Streamlit port (default=8501)
Outputs:
    out: Status message"""

import subprocess
import sys
import os
import psutil
import time

import sys
sys.path.append(project_library_path)
from interface import rhino_client

# Initialize inputs
if not run: run = False
if not ws_port: ws_port = 8765
if not streamlit_port: streamlit_port = 8501

def cleanup_servers():
    """Kill any running server processes"""
    killed = 0
    for proc in psutil.process_iter(['pid', 'name']):
        try:
            if 'python' in proc.info['name'].lower():
                # Get command line args
                cmdline = ' '.join(proc.cmdline()).lower()
                if 'ws_app.py' in cmdline or 'streamlit' in cmdline:
                    # Kill process and its children
                    parent = psutil.Process(proc.info['pid'])
                    for child in parent.children(recursive=True):
                        try:
                            child.kill()
                            killed += 1
                        except:
                            pass
                    try:
                        parent.kill()
                        killed += 1
                    except:
                        pass
        except:
            continue
    return killed

def start_servers():
    """Start both WebSocket and Streamlit servers"""
    try:
        # Use the Python environment that Rhino is using
        rhino_python = os.path.join(sys.prefix, "pythonw.exe")
        if not os.path.exists(rhino_python):
            print(f"Could not find Python at {rhino_python}")
            return False
            
        script_dir = os.path.dirname(os.path.abspath(ghdoc.Path))
        parent_dir = os.path.dirname(script_dir)  # Go up one level
        
        # Start WebSocket server
        ws_script = os.path.join(script_dir, "code/interface", "ws_app.py")
        subprocess.Popen([
            rhino_python,
            ws_script
        ], 
        cwd=parent_dir,  # Set working directory to project root
        creationflags=subprocess.CREATE_NO_WINDOW)
        
        # Start Streamlit (using same Python)
        streamlit_script = os.path.join(script_dir, "code/interface", "streamlit_app.py")
        subprocess.Popen([
            rhino_python,
            "-m", "streamlit",
            "run", streamlit_script,
            "--server.port", str(streamlit_port)
        ],
        cwd=parent_dir,  # Set working directory to project root
        creationflags=subprocess.CREATE_NO_WINDOW)
        
        # Give servers time to start
        time.sleep(2)
        return True
    except Exception as e:
        print(f"Error starting servers: {e}")
        return False


# Main logic
if run:
    # First cleanup any existing servers and stop client
    cleanup_servers()
    rhino_client.stop_connection()
    
    # Then start new servers and client
    if start_servers():
        # Give servers time to start before connecting client
        time.sleep(2)
        if rhino_client.start_connection():
            output = f"Started servers and connected client"
        else:
            output = "Servers started but client connection failed"
    else:
        output = "Failed to start servers"
else:
    # Stop everything
    rhino_client.stop_connection()
    killed = cleanup_servers()
    output = f"Stopped {killed} server processes and client"

# Set output
a = output
# ---------- end server_controller ----------
pt = Point(<point referenced from the Rhino model>)
py3_6 = Python3Script(data_in=py3_4.data_out, path=panel)  # -> result
# ---------- py3_6: Python ----------
import json
import polars as pl

import sys
import importlib as imp


sys.path.append(path)

import flow_form as pjct
imp.reload(pjct)
print(pjct)


# Convert the baffle data from the input into a dictionary
baffle_dataframe_dictionary = data_in.baffles

# Create a Polars DataFrame from the baffle dictionary
df = pl.DataFrame(baffle_dataframe_dictionary)

# Select specific columns from the DataFrame and convert to a list of dictionaries
baffle_data = df.select([
    pl.col("baffle_name"),    # select the 'baffle_name' column
    pl.col("baffle_length"),  # select the 'baffle_length' column
    pl.col("centerline_id"),  # select the 'centerline_id' column
    pl.col("baffle_type")     # select the 'baffle_type' column
]).to_dicts()

# Print the resulting baffle data
print(baffle_data)

# Save the baffle data to a JSON file
# The file will be named 'data.json' and saved in the directory specified by 'path'
pjct.Utils.save_to_json(baffle_data, f"{path}/data/data.json")
# ---------- end py3_6 ----------
py3_7 = Python3Script(data_in=py3_4.data_out)  # -> a, b, c, d, e
# ---------- py3_7: Python ----------
import polars as pl


baffle_dataframe_dictionary = data_in.baffles
max_baffle_length = data_in.max_length

pl.Config(tbl_cols=-1, fmt_str_lengths=3000, tbl_rows=-1, fmt_table_cell_list_len=2000, tbl_formatting="ASCII_MARKDOWN")

#
df = pl.DataFrame(baffle_dataframe_dictionary)

#
df2 = df.select(pl.col("baffle_type").value_counts().alias("counts"))

#
df3 = df.group_by("centerlines").agg(
    baffle_length =pl.col("baffle_length"),
    total_length=pl.col("baffle_length").sum(),
    total_type_count = pl.col("baffle_type").value_counts(),
    object_count = pl.col("baffle_name")
)
print(df2)
print(df3)
#
df4 = df.filter(pl.col("baffle_length") > max_baffle_length)
print(df4)
#
curve_list = [item["baffles"].baffle_curve for item in df4.iter_rows(named=True)]
print(curve_list)



a = df
b = df2
c = df3
d = df4
e = curve_list
# ---------- end py3_7 ----------
py3_8 = Python3Script(origin=pt, project_library_path=panel, data_in=py3_4.data_out)  # -> plane_list, solids; inputs origin: Point3d; disabled
# ---------- py3_8: Python ----------
import Rhino as rh
import Rhino.Geometry as rg
import scriptcontext as sc
import rhinoscriptsyntax as rs
import ghpythonlib as gh

import numpy as np
import sys
import importlib as imp

# Add project library to system path
sys.path.append(project_library_path)

# Import and reload local project module
import flow_form as pjct
imp.reload(pjct)

# Debug output of baffle data
print(set(data_in.baffles["centerline_list"]))
print(data_in.baffles["baffles"])

# Extract centerlines and baffles from input data
centerlines = data_in.baffles["centerline_list"]
baffles = data_in.baffles["baffles"]

solids = []
# iterate centerlines
for i, centerline in enumerate(set(centerlines)):
    
    # iterate centerline baffles
    for j, baffle in enumerate(centerline.baffles):
        print(baffle)
        
        # Create reference plane at world origin
        base_plane = rg.Plane(origin, rg.Vector3d(1, 0, 0), rg.Vector3d(0, 1, 0))
        
        # Create offset plane for baffle positioning
        baffle_plane = base_plane.Clone()
        baffle_plane.Translate(rg.Vector3d(3000*j, 5000*i, 0))
        
        # Create plane at baffle bounding box center
        bbox = rg.BoundingBox([baffle.baffle_curve.PointAtEnd, baffle.baffle_curve.PointAtStart])
        bbox_plane = rg.Plane(bbox.Center, rg.Vector3d(1, 0, 0), rg.Vector3d(0, 1, 0))

        # Create solid geometry by offsetting baffle surface
        offset = rg.Brep.CreateOffsetBrep(baffle.surface(depth=centerline.depth).ToBrep(), -centerline.thickness/2, False, True, 0.01)[0][0]
        solid = rg.Brep.CreateOffsetBrep(offset, centerline.thickness, True, True, 0.01)[0][0]
        
        # Transform solid to target position
        solid.Transform(rg.Transform.PlaneToPlane(bbox_plane, baffle_plane))
        solids.append(solid)
# ---------- end py3_8 ----------
pln_2 = Plane(py3_8.plane_list)
brep_2 = Brep(py3_8.solids)
panel_5 = Panel(py3_4.out)
py3_9 = Python3Script(x=Slider(10, range=1..1000))  # -> a; inputs x: Int32
# ---------- py3_9: Python ----------
import numpy as np


a = list(np.linspace(1,10,x,True))
# ---------- end py3_9 ----------
crv_5 = Curve(py3_7.e)
graph = GraphMapper(py3_9, x0=0, x1=1, y0=0, y1=1, A=1, B=0, container_name="Linear")
panel_6 = Panel(py3_9)
py3_10 = Python3Script(input_num=graph, y=Slider(1, range=1..1000))  # -> a
# ---------- py3_10: Python ----------
a = input_num*(y+1)
# ---------- end py3_10 ----------
panel_7 = Panel(graph)
